# Grasshopper definition GrasshopperScriptTest.gh (Grasshopper 1.0.7)
# plug-ins: MeshEdit Components, Kangaroo Components, Alpaca4d, LunchBox, Weaverbird, Kangaroo2 Components, TetgenGH

brep = Brep(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)
mesh = MeshBrep(
    Brep=brep,
    Settings={GridMaxCount=0, GridMinCount=16, JaggedSeams=False, MaxEdgeLength=0, MinEdgeLength=0.0001, MinTolerance=0, Refine=True, RefineAngle=0, RelativeTolerance=0, SimplePlanes=True, Tolerance=0})
tetgen = Tetrahedralize(Mesh=mesh, Flags=Slider(0, range=0..10), MinRatio=Slider(1.3, range=0..10))  # -> Mesh, Indices, Points
deconstruct_mesh = DeconstructMesh(Mesh=tetgen.Mesh)  # -> Vertices, Faces, Colours, Normals
removeduplicatepts = RemoveDuplicatePts(Points=flatten(deconstruct_mesh.Vertices), Tolerance=0.01)
pdecon = Deconstruct(Point=removeduplicatepts)  # -> XComponent, YComponent, ZComponent
pdecon_2 = Deconstruct(Point=removeduplicatepts)  # -> XComponent, YComponent, ZComponent
larger_than = LargerThan(FirstNumber=pdecon.XComponent, SecondNumber="25")  # -> LargerThan, OrEqualTo
smaller = SmallerThan(FirstNumber=pdecon_2.XComponent, SecondNumber="0.1")  # -> SmallerThan, OrEqualTo
cull = CullPattern(List=removeduplicatepts, CullPattern=smaller.SmallerThan)  # -> graft(List)
cull_2 = CullPattern(List=removeduplicatepts, CullPattern=larger_than.LargerThan)  # -> graft(List)
point = Point(cull)
point_2 = Point(cull_2)
support = Point(point)
pointload = Point(point_2)
vec = VectorXYZ(XComponent=0, YComponent=0, ZComponent="-100")  # -> Vector, Length
entwine = Entwine(Branch03=support, Branch04=pointload, Branch05=vec.Vector, Branch012=graft(tetgen.Mesh), FlattenInputs=True)

number_slider = Slider(5, range=0..100)

# ---- group: Element
data = Data(0)
data_2 = Data(0)

# ---- group: Load
data_3 = Data(0)
data_4 = Data(0)

# ---- group: Cross-Section
data_5 = Data(0)
data_6 = Data(0)

# ---- group: Support
data_7 = Data(0)
data_8 = Data(0)

# ----
# Model 4
number_slider_2 = Slider(60, range=0..100)
construct_point = ConstructPoint(XCoordinate=0, YCoordinate=0, ZCoordinate=0)
construct_point_2 = ConstructPoint(XCoordinate=number_slider_2, YCoordinate=0, ZCoordinate=0)
unit_z = UnitZ(Factor=Slider(10, range=0..10))
line = Line(StartPoint=construct_point, EndPoint=construct_point_2)
move = Move(Geometry=line, Motion=unit_z)  # -> Geometry, Transform
panel = Panel(number_slider_2)
_2d_truss = _2DTruss(CurveA=line, CurveB=move.Geometry, Divisions=Slider(5, range=0..10), TrussToggle=0)  # -> PrimaryLines, BraceLines, VerticalLines, StructureNodes
pdecon_3 = Deconstruct(Point=_2d_truss.StructureNodes)  # -> XComponent, YComponent, ZComponent
pdecon_4 = Deconstruct(Point=_2d_truss.StructureNodes)  # -> XComponent, YComponent, ZComponent
equality = Equality(FirstNumber=pdecon_4.XComponent, SecondNumber=panel)  # -> Equality, Inequality
smaller_2 = SmallerThan(FirstNumber=pdecon_3.XComponent, SecondNumber="0.1")  # -> SmallerThan, OrEqualTo
merge = Merge(Data1=_2d_truss.PrimaryLines, Data2=_2d_truss.BraceLines, Data3=_2d_truss.VerticalLines)
cull_3 = CullPattern(List=_2d_truss.StructureNodes, CullPattern=equality.Equality)  # -> flatten(List)
cull_4 = CullPattern(List=_2d_truss.StructureNodes, CullPattern=smaller_2.SmallerThan)  # -> flatten(List)
vec_2 = VectorXYZ(XComponent=0, YComponent=0, ZComponent="-100")  # -> Vector, Length
pointload_2 = Point(cull_3)
support_2 = Point(cull_4)
beam = Curve(merge)
entwine_2 = Entwine(Branch01=beam, Branch03=support_2, Branch04=pointload_2, Branch05=vec_2.Vector, FlattenInputs=True)

series = Series(Start="0", Step="0.50", Count="2")

# ---- group: Material
data_9 = Data(0)
data_10 = Data(0)

# ---- group: Constraint
data_11 = Data(0)
data_12 = Data(0)

# ----
curve = Curve([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])

# ----
# Model 2
number_slider_3 = Slider(6, range=0..10)
vector_xyz = VectorXYZ(XComponent=0, YComponent=0, ZComponent=0)  # -> Vector, Length
vector_xyz_2 = VectorXYZ(XComponent=0, YComponent=0, ZComponent=number_slider_3)  # -> Vector, Length
move_2 = Move(Geometry=vector_xyz.Vector, Motion=vector_xyz_2.Vector)  # -> Geometry, Transform
line_2 = Line(StartPoint=vector_xyz.Vector, EndPoint=move_2.Geometry)
num = Number("0")
pointload_3 = Point(move_2.Geometry)
vec_3 = VectorXYZ(XComponent=0, YComponent=Slider(6, range=-20..20), ZComponent=0)  # -> Vector, Length
pointload_4 = Point(move_2.Geometry)
vec_4 = VectorXYZ(XComponent=Slider(0, range=-20..20), YComponent=0, ZComponent=0)  # -> Vector, Length
support_3 = Point(vector_xyz.Vector)
beam_2 = Curve(line_2)
columns = Curve(beam_2)
entwine_3 = Entwine(
    Branch01=beam_2,
    Branch03=support_3,
    Branch04=pointload_4,
    Branch05=vec_3.Vector,
    Branch06=columns,
    Branch07=vec_4.Vector,
    Branch010=pointload_3,
    Branch011=num,
    FlattenInputs=True)

# ----
# Model 1
number_slider_4 = Slider(10, range=0..40)
number_slider_5 = Slider(20, range=0..40)
mesh_plane = MeshPlane(
    Boundary={Plane=PlaneXY(0, 0, 0), Size=Domain2(u=-10..10, v=-10..10)},
    WidthCount=number_slider_4,
    HeightCount=number_slider_4)  # -> Mesh, Area
shell = Mesh(mesh_plane.Mesh)
clean = CombineClean(Meshes=shell)
explode = MeshExplode(Mesh=clean, Interpolate=False)  # -> flatten(Faces)
demesh = DeconstructMesh(Mesh=clean)  # -> Vertices, Faces, Colours, Normals
area = Area(Geometry=mesh_plane.Mesh)  # -> Area, Centroid
area_2 = Area(Geometry=explode)  # -> Area, Centroid
distance = Distance(PointA=area.Centroid, PointB=area_2.Centroid)
bounds = Bounds(Numbers=distance)
nakedvertices = NakedVertices(Mesh=mesh_plane.Mesh)  # -> ClothedIndex, NakedIndex, ClothedPts, NakedPts
difference = SetDifference(SetA=demesh.Vertices, SetB=nakedvertices.NakedPts)
mc = MeshCorners(Mesh=clean, Angle=2.35619449)
deconstruct_domain = DeconstructDomain(Domain=bounds)  # -> Start, End
vec_5 = VectorXYZ(XComponent=Slider(17, range=-20..20), YComponent=Slider(20, range=-20..20), ZComponent=Slider(-100, range=-100..20))  # -> Vector, Length
maximum = Maximum(A=deconstruct_domain.Start, B=deconstruct_domain.End)
pointload_5 = Point(difference)
support_4 = Point(nakedvertices.NakedPts)
similarity = Similarity(FirstNumber=distance, SecondNumber=maximum, Threshold=Slider(1e-06, range=0..1e-06))  # -> Similarity, AbsoluteDifference
dispatch = Dispatch(List=explode, DispatchPattern=similarity.Similarity)  # -> ListA, ListB
entwine_4 = Entwine(Branch00=explode, Branch03=support_4, Branch04=pointload_5, Branch05=vec_5.Vector, FlattenInputs=True)

explode_2 = Explode(Curve=curve, Recursive=True)  # -> Segments, Vertices
unit_z_2 = UnitZ(Factor=series)
triangulate = Triangulate(Mesh=shell)  # -> Mesh, Count
removeduplicatepts_2 = RemoveDuplicatePts(Points=flatten(explode_2.Vertices), Tolerance=0.01)
refine = Refine(Mesh=triangulate.Mesh, Level="0")
construct_domain = ConstructDomain(DomainStart=Slider(1, range=0..1), DomainEnd=Slider(8, range=0..10))
deconstruct = Deconstruct(Point=removeduplicatepts_2)  # -> XComponent, YComponent, ZComponent
vec_6 = VectorXYZ(XComponent=Slider(11, range=-20..20), YComponent=Slider(11, range=-20..20), ZComponent=0)  # -> Vector, Length
panel_2 = Panel("0.50")
smaller_than = SmallerThan(FirstNumber=deconstruct.ZComponent, SecondNumber="1")  # -> SmallerThan, OrEqualTo
series_2 = Series(Start="0", Step="0.50", Count=Slider(3, range=0..10))
list = ValueList({"Building": 0, "Shell": 1, "Cantiliver": 2, "Brick esaedro": 3, "Truss": 4, "telaio": 5, "Brick tetraedro": 6, "Building  2": 7}, selected="Building")
construct_domain_2 = ConstructDomain(DomainStart=Slider(1, range=0..1), DomainEnd=Slider(8, range=0..10))
dispatch_2 = Dispatch(List=removeduplicatepts_2, DispatchPattern=smaller_than.SmallerThan)  # -> ListA, ListB
unit_z_3 = UnitZ(Factor=series_2)
vec_7 = VectorXYZ(XComponent=Slider(11, range=-20..20), YComponent=Slider(11, range=-20..20), ZComponent=0)  # -> Vector, Length
addition = Addition(A="25", B=Slider(30, range=0..100))
vector_xyz_3 = VectorXYZ(XComponent=addition, YComponent=Slider(30, range=0..100), ZComponent=Slider(43, range=0..100))  # -> Vector, Length
point_3 = Point(vector_xyz_3.Vector)
line_3 = Line(StartPoint=cull_2, EndPoint=point_3)
item_index = ItemIndex(List=explode, Item=dispatch.ListA)
mesh_2 = Mesh(dispatch.ListA)

# ----
# UniaxialMaterial
# Elastic
file_path = FilePath("C:\GitHub\Alpaca4d\PythonScript\Pre-Processing\Material\uniAxialMaterial\ElasticUniaxialMaterial.py")
read_file = ReadFile(File=file_path, PerLineParse=False)
python = GhPythonScript(Code=read_file, MatName="S275", E="210000", G="80760", Rho="75", Fy="35")  # -> Out, UniaxialMaterial
python_2 = GhPythonScript(x=python.UniaxialMaterial)  # -> out, a
# ---------- python_2: Python ----------
a = x
# ---------- end python_2 ----------
panel_3 = Panel(python_2.a)

# ----
# UniaxialMaterial
# Elastic
panel_4 = Panel("210000")
python_3 = GhPythonScript(Code=read_file, MatName="S255", E=panel_4, G="80760", Rho="75", Fy="25")  # -> Out, UniaxialMaterial
python_4 = GhPythonScript(x=python_3.UniaxialMaterial)  # -> out, a; same code as python_2
panel_5 = Panel(python_4.a)

# ----
# nDMaterial
# ElasticIsotropic
file_path_2 = FilePath("C:\GitHub\Alpaca4d\PythonScript\Pre-Processing\Material\nDMaterial\ElasticIsotropic.py")
read_file_2 = ReadFile(File=file_path_2, PerLineParse=False)
python_5 = GhPythonScript(Code=read_file_2, MatName="S275", E="210000", G="80760", Rho="75", Fy="35")  # -> Out, NDMaterial

# ----
# Generic Cross Section
file_path_3 = FilePath("C:\GitHub\Alpaca4d\PythonScript\Pre-Processing\Section\GenericCrossSection.py")
read_file_3 = ReadFile(File=file_path_3, PerLineParse=False)
python_6 = GhPythonScript(
    Code=read_file_3,
    SectionName="Generic",
    Area="20",
    Ay="20",
    Az="20",
    Iyy="20",
    Izz="20",
    J="20",
    UniaxialMaterial=python.UniaxialMaterial)  # -> Out, CrossSection

file_path_4 = FilePath("C:\GitHub\Alpaca4d\PythonScript\Pre-Processing\Load\BeamLoad.py")

# ----
# WIP
panel_6 = Panel("100")
random = Random(Range="20", Number=panel_6, Seed=2)
random_2 = Random(Range="20", Number=panel_6, Seed="3")
pt = ConstructPoint(XCoordinate=random, YCoordinate=random_2, ZCoordinate=0)
python_7 = GhPythonScript(Pos=pt, RigidDiaphragm=Toggle(True))  # -> Out, A

# ----
# Circular CrossSection
file_path_5 = FilePath("C:\GitHub\Alpaca4d\PythonScript\Pre-Processing\Section\CircularCrossSection.py")
read_file_4 = ReadFile(File=file_path_5, PerLineParse=False)
python_8 = GhPythonScript(Code=read_file_4, SectionName="CHS", Diameter="400", Thickness="40", UniaxialMaterial=python_3.UniaxialMaterial)  # -> Out, CrossSection

read_file_5 = ReadFile(File=file_path_4, PerLineParse=False)

# ----
# Rectangular Cross Section
file_path_6 = FilePath("C:\GitHub\Alpaca4d\PythonScript\Pre-Processing\Section\RectangularCrossSection.py")
read_file_6 = ReadFile(File=file_path_6, PerLineParse=False)
python_9 = GhPythonScript(Code=read_file_6, SectionName="RHS", Base="300", Height="300", UniaxialMaterial=python.UniaxialMaterial)  # -> Out, CrossSection

# ----
# Elastic Membrane Plate Section
file_path_7 = FilePath("C:\GitHub\Alpaca4d\PythonScript\Pre-Processing\Section\ElasticMembranePlateSection.py")
read_file_7 = ReadFile(File=file_path_7, PerLineParse=False)
python_10 = GhPythonScript(Code=read_file_7, SectionName="concreteSlab", Thickness="250", NDMaterial=python_5.NDMaterial)  # -> Out, CrossSection

int = Integer(Toggle(False))
panel_7 = Panel(int)
python_11 = GhPythonScript(Force=Point(0, 0, 0), Moment=Point(0, 0, 0))  # -> flatten(LoadWrapper); inputs Force: Vector3d, Moment: Vector3d, Pos: Point3d
# ---------- python_11: Python ----------
"""Generate a point load.
    Inputs:
        Force: Input force vector [kN].
        Moment: Input moment vector [kN].
        Pos: Point to apply the loads.
    Output:
       LoadWrapper: Load element.
       """


from ghpythonlib.componentbase import executingcomponent as component
import Grasshopper, GhPython
import System
import Rhino
import rhinoscriptsyntax as rs

class MyComponent(component):
    
    def RunScript(self, Force, Moment, Pos):
        
        import Rhino.Geometry as rg
        import Grasshopper as gh
        
        def pointLoad(Force, Moment, Pos):
        
            Pos = Pos
            Force = rg.Vector3d(0,0,0) if Force is None else Force                   # Input value in kN ---> Output kN
            Moment = rg.Vector3d(0,0,0) if Moment is None else Moment                 # Input value in kNm ---> Output kNm
            loadType = "pointLoad"
        
            return [[Pos, Force, Moment, loadType]]
        
        checkData = True
        
        if Force is None:
            checkData = False
            msg = "input 'Force' failed to collect data"
            ghenv.Component.AddRuntimeMessage(gh.Kernel.GH_RuntimeMessageLevel.Warning, msg)
        
        if Moment is None:
            checkData = False
            msg = "input 'Moment' failed to collect data"
            ghenv.Component.AddRuntimeMessage(gh.Kernel.GH_RuntimeMessageLevel.Warning, msg)
        
        if Pos is None:
            checkData = False
            msg = "input 'Pos' failed to collect data"
            ghenv.Component.AddRuntimeMessage(gh.Kernel.GH_RuntimeMessageLevel.Warning, msg)
        
        
        if checkData != False:
            LoadWrapper = pointLoad(Force, Moment, Pos)
            return LoadWrapper
# ---------- end python_11 ----------
file_path_8 = FilePath("C:\GitHub\Alpaca4d\PythonScript\Pre-Processing\Element\Brick\BbarBrick.py")
read_file_8 = ReadFile(File=file_path_8, PerLineParse=False)

# ---- group: Rectangular Hollow Cross Section
file_path_9 = FilePath("C:\GitHub\Alpaca4d\PythonScript\Pre-Processing\Section\RectangularHollowCrossSection.py")
read_file_9 = ReadFile(File=file_path_9, PerLineParse=False)
python_12 = GhPythonScript(Code=read_file_9, SectionName="RHS", Base="300", Height="300", Thickness="25", UniaxialMaterial=python.UniaxialMaterial)  # -> Out, CrossSection

# ----
# doubleT CrossSection
file_path_10 = FilePath("C:\GitHub\Alpaca4d\PythonScript\Pre-Processing\Section\doubleTCrossSection.py")
read_file_10 = ReadFile(File=file_path_10, PerLineParse=False)
python_13 = GhPythonScript(
    Code=read_file_10,
    SectionName="TT",
    Bsup="300",
    Binf="600",
    H="500",
    Tsup="100",
    Tinf="100",
    Tw="100",
    UniaxialMaterial=python_3.UniaxialMaterial)  # -> Out, CrossSection

range = Range(Domain=Domain(0, 1), Steps=10)
series_3 = Series(Start=0, Step=Slider(0.1, range=0..0.1), Count="21")
boolean_toggle = BooleanToggle(False)  # disabled
boolean_toggle_2 = BooleanToggle(True)  # disabled
boolean_toggle_3 = BooleanToggle(True)  # disabled
path = FilePath("C:\GitHub\Alpaca4d\PythonScript\Analyses\LinearAnalyses\initializeAnalysis.py")
construct_domain_3 = ConstructDomain(DomainStart="0", DomainEnd="200")
# solver on folder Static Analyses 3ndf
# solver on folder Static Analyses
path_2 = FilePath("C:\GitHub\Alpaca4d\PythonScript\Analyses\openSees_StaticSolver_3ndf\initializeAnalysis_3ndf.py")  # disabled
panel_8 = Panel(path)
# solver on folder Static Analyses
file = ReadFile(File=path, PerLineParse=False)
file_2 = ReadFile(File=path_2, PerLineParse=False)  # disabled
analyze = GhPythonScript()  # -> AlpacaStaticOutput; inputs AlpacaModel: list; disabled
# ---------- analyze: Python ----------
"""Calculate the Static Response of the structure
    Inputs:
        AlpacaModel: Assemble model to perform Static Analyses.
    Output:
       AlpacaStaticOutput: Analysed Alpaca model.
       maxDisplacement: Maximum displacement of structure [mm].
       """


from ghpythonlib.componentbase import executingcomponent as component
import Grasshopper, GhPython
import System
import Rhino
import rhinoscriptsyntax as rs

class MyComponent(component):
    
    def RunScript(self, AlpacaModel):
        
        
        import System
        import os
        import Grasshopper as gh
        
        def InitializeStaticAnalysis(AlpacaModel):
            
            ghFilePath = ghenv.Component.Attributes.Owner.OnPingDocument().FilePath
            workingDirectory = os.path.dirname(ghFilePath) 
            outputFileName = 'openSeesOutputWrapper.txt'
        
            for dirpath, dirnames, filenames in os.walk(workingDirectory):
                for filename in filenames:
                    if filename == outputFileName:
                        file = os.path.join(dirpath,outputFileName)
                        os.remove(file)
        
        
        
            ghFolderPath = os.path.dirname(ghFilePath)
            outputFolder = os.path.join(ghFolderPath,'assembleData')
            wrapperFile = os.path.join( outputFolder,'openSeesModel.txt' )
        
            userObjectFolder = gh.Folders.DefaultUserObjectFolder
            pythonInterpreter = os.path.join(userObjectFolder, r'Alpaca4d\Analyses\WPy64\scripts\winpython.bat')
            fileName = os.path.join(userObjectFolder, r'Alpaca4d\Analyses\LinearAnalyses\openSees_StaticSolver.py')
            
            wrapperFile = '"' + wrapperFile + '"'
            fileName = '"' + fileName + '"'
            
            p = System.Diagnostics.Process()
            p.StartInfo.RedirectStandardOutput = True
            p.StartInfo.RedirectStandardError = True
        
            p.StartInfo.UseShellExecute = False
            p.StartInfo.CreateNoWindow = True
            
            p.StartInfo.FileName = pythonInterpreter
            p.StartInfo.Arguments = fileName + " " + wrapperFile
            p.Start()
            p.WaitForExit()
            
            
            msg = p.StandardError.ReadToEnd()
            ghenv.Component.AddRuntimeMessage(gh.Kernel.GH_RuntimeMessageLevel.Error, msg)
        
        
            ## READ THE OUTPUT FROM THE OPEENSEES_SOLVER
            ## THE ORDER MUST BE THE SAME OF THE OUTPUT LIST IN OpenSeesStaticSolver.py
        
            outputFile = os.path.join(outputFolder, outputFileName)
        
            with open(outputFile, 'r') as f:
                lines = f.readlines()
                nodeDisplacementWrapper = eval( lines[0].strip() )
                reactionWrapper = eval( lines[1].strip() )
                elementOutputWrapper = eval( lines[2].strip() )
                elementLoadWrapper = eval( lines[3].strip() )
                eleForceWrapper = eval( lines[4].strip() )
        
        
            AlpacaLinearStaticOutput = ([nodeDisplacementWrapper,
                                    reactionWrapper,
                                    elementOutputWrapper,
                                    elementLoadWrapper,
                                    eleForceWrapper])
        
            return AlpacaLinearStaticOutput
        
        
        checkData = True
        
        if not AlpacaModel:
            checkData = False
            msg = "input 'AlpacaModel' failed to collect data"
            ghenv.Component.AddRuntimeMessage(gh.Kernel.GH_RuntimeMessageLevel.Warning, msg)
        
        
        if checkData != False:
            AlpacaStaticOutput = InitializeStaticAnalysis(AlpacaModel)
            #maxDisplacement = None
            return AlpacaStaticOutput
# ---------- end analyze ----------
analyze_2 = GhPythonScript()  # -> AlpacaModalOutput, Frequency, Period; disabled
range_2 = Range(Domain=construct_domain_3, Steps=Slider(20, range=0..100))
arccosine = ArcCosine(Value=range_2)
sine = Sine(Value=range_2)

# ----
# Modal Animate
number_slider_6 = Slider(7, range=0..10)
path_3 = FilePath("C:\GitHub\Alpaca4d\PythonScript\Post-Processing\animateModal\animateModal.py")
file_3 = ReadFile(File=path_3, PerLineParse=False)

toggle = BooleanToggle(False)
panel_9 = Panel("1")
number_of_line_to_skip = Slider(30, range=1..100)  # disabled
number_slider_7 = Slider(1000, range=0..1000)  # disabled
path_4 = FilePath("C:\GitHub\Alpaca4d\PythonScript\Post-Processing\viewGroundAccAnalyses\viewGroundAccAnalyses.py")
reaction_forces_alpaca4d = ReactionForcesAlpaca4d()  # -> TagPoints, ReactionForce, ReactionMoment
file_4 = ReadFile(File=path_4, PerLineParse=False)
toggle_2 = BooleanToggle(True)  # disabled
button = Button()  # disabled
toggle_3 = BooleanToggle(True)  # disabled

# ----
# Disp Numerical Ouput
# OK!
# Force component
number_slider_8 = Slider(10, range=0..10)  # disabled
file_path_11 = FilePath("C:\GitHub\Alpaca4d\PythonScript\Post-Processing\beamDisp\beamDisp.py")  # disabled
file_path_12 = FilePath("C:\GitHub\Alpaca4d\PythonScript\Post-Processing\nodalDisp\nodalDisp.py")  # disabled
file_path_13 = FilePath("C:\GitHub\Alpaca4d\PythonScript\Post-Processing\brickDisp\brickDisp.py")  # disabled
file_path_14 = FilePath("C:\GitHub\Alpaca4d\PythonScript\Post-Processing\shellDisp\shellDisp.py")  # disabled
read_file_11 = ReadFile(File=file_path_11, PerLineParse=False)  # disabled
read_file_12 = ReadFile(File=file_path_14, PerLineParse=False)  # disabled
read_file_13 = ReadFile(File=file_path_12, PerLineParse=False)  # disabled
read_file_14 = ReadFile(File=file_path_13, PerLineParse=False)  # disabled

file_path_15 = FilePath("C:\GitHub\Alpaca4d\PythonScript\function\AlpacaColorMesh.py")  # disabled
read_file_15 = ReadFile(File=file_path_15, PerLineParse=False)  # disabled
list_2 = ValueList({"8Color": 0, "20Color": 1}, selected="8Color")  # disabled
ghpython_script = GhPythonScript(Code=read_file_15)  # -> Out, Color, Tag, Domain, ColorValue; disabled

circle = Circle(Plane=PlaneXY(0, 0, 0), Radius=Slider(10, range=0..10))
mesh_3 = Mesh(circle)
refine_2 = Refine(Mesh=mesh_3, Level="0")
weaverbird_s_naked_boundary = WeaverbirdsNakedBoundary(MeshClosedPolylines=refine_2)
number_slider_9 = Slider(2, range=0..100)
subtraction = Subtraction(A=number_slider_9, B="1")
explode_3 = Explode(Curve=weaverbird_s_naked_boundary, Recursive=True)  # -> Segments, Vertices
series_4 = Series(Start="0", Step="4", Count=number_slider_9)
removeduplicatepts_3 = RemoveDuplicatePts(Points=flatten(explode_3.Vertices), Tolerance=0.01)
series_5 = Series(Start="4", Step="4", Count=subtraction)
unit_z_4 = UnitZ(Factor=series_4)
unit_z_5 = UnitZ(Factor=series_5)
move_3 = Move(Geometry=graft(removeduplicatepts_3), Motion=unit_z_4)  # -> simplify(Geometry), Transform
move_4 = Move(Geometry=graft(refine_2), Motion=unit_z_5)  # -> Geometry, Transform
shift_list = ShiftList(List=move_3.Geometry, Shift=1, Wrap=True)
deconstruct_mesh_2 = DeconstructMesh(Mesh=move_4.Geometry)  # -> Vertices, Faces, Colours, Normals
removeduplicatepts_4 = RemoveDuplicatePts(Points=flatten(deconstruct_mesh_2.Vertices), Tolerance=0.01)
pdecon_5 = Deconstruct(Point=removeduplicatepts_4)  # -> XComponent, YComponent, ZComponent
larger_than_2 = LargerThan(FirstNumber=pdecon_5.XComponent, SecondNumber="9")  # -> LargerThan, OrEqualTo
vincoli = Point(removeduplicatepts_3)
cull_5 = CullPattern(List=removeduplicatepts_4, CullPattern=larger_than_2.LargerThan)  # -> flatten(List)
vec_8 = VectorXYZ(XComponent="-100", YComponent=0, ZComponent=0)  # -> Vector, Length
pointload_6 = Point(cull_5)
support_5 = Point(vincoli)

cull_nth = CullNth(List=simplify(shift_list), CullFrequency=number_slider_9)
cull_nth_2 = CullNth(List=simplify(move_3.Geometry), CullFrequency=number_slider_9)
mesh_explode = MeshExplode(Mesh=move_4.Geometry, Interpolate=False)

line_4 = Line(StartPoint=cull_nth_2, EndPoint=cull_nth)  # -> flatten(Line)
colonne = RemoveDuplicateLines(Lines=line_4, Tolerance=0.01)
entwine_5 = Entwine(
    Branch00=mesh_explode,
    Branch01=colonne,
    Branch03=support_5,
    Branch04=pointload_6,
    Branch05=vec_8.Vector,
    FlattenInputs=True)

rectangle = Rectangle(Plane=PlaneXY(0, 0, 0), XSize="10", YSize="20", Radius=0)  # -> Rectangle, Length
mesh_surface = MeshSurface(Surface=rectangle.Rectangle, UCount=number_slider, VCount=number_slider, Overhang=True, Equalize=False)
weaverbird_s_offset_mesh = WeaverbirdsOffsetMesh(MeshCurves=mesh_surface, Distance=graft(series), OffsetType=0)
entwine_6 = Entwine(Branch00=mesh_surface, Branch01=weaverbird_s_offset_mesh, FlattenInputs=True)
subtraction_2 = Subtraction(A="10", B="1")
vec_9 = VectorXYZ(XComponent=0, YComponent=0, ZComponent="-100")  # -> Vector, Length

move_5 = Move(Geometry=mesh_surface, Motion=unit_z_2)  # -> flatten(Geometry), Transform

# ---- group: brith to loft mesh
ghpython_script_2 = GhPythonScript(MeshSeries=move_5.Geometry, color=ColourSwatch(SwatchColor=RGB(4, 0, 255)))  # -> out, simplify(flatten(Brick)); inputs MeshSeries: list of Mesh
# ---------- ghpython_script_2: Python ----------
import Rhino.Geometry as rg

def MeshToShell(Mesh):
    
    Mesh.Unweld(0, True)
    mesh = Mesh.ExplodeAtUnweldedEdges()
    newMesh = []
    elementType = []
    for explodedMesh in mesh:
        newMesh.append(explodedMesh)
    return newMesh 

def brick( MeshList, color ):
    meshExpl = []
    Vertix = []
    elementType = []
    solid = []
    
    for Mesh in MeshList:
        shellWrapper = MeshToShell(Mesh)
        meshExpl.append( shellWrapper )
    for index1 in range(0, len(MeshList)-1):
        for index2 in range(0, len(meshExpl[0])):
            if meshExpl[ index1 ][ index2 ].Vertices.Count == 4:
                
                elementType.append("stdBrick")
                vertix1 = meshExpl[ index1 ][ index2 ].Vertices[0]
                vertix2 = meshExpl[ index1 ][ index2 ].Vertices[1]
                vertix3 = meshExpl[ index1 ][ index2 ].Vertices[2]
                vertix4 = meshExpl[ index1 ][ index2 ].Vertices[3]
                vertix5 = meshExpl[index1 + 1 ][ index2].Vertices[0]
                vertix6 = meshExpl[index1 + 1 ][ index2].Vertices[1]
                vertix7 = meshExpl[index1 + 1 ][ index2].Vertices[2]
                vertix8 = meshExpl[index1 + 1 ][ index2].Vertices[3]
                
                vertix = [ vertix1, vertix2, vertix3, vertix4,
                vertix5, vertix6, vertix7, vertix8 ]
                
                ele = rg.Mesh()
                
                ele.Vertices.Add( vertix1 ) # 0 
                ele.Vertices.Add( vertix2 ) # 1
                ele.Vertices.Add( vertix3 ) # 2
                ele.Vertices.Add( vertix4 ) # 3
                ele.Vertices.Add( vertix5 ) # 4
                ele.Vertices.Add( vertix6 ) # 5
                ele.Vertices.Add( vertix7 ) # 6
                ele.Vertices.Add( vertix8 ) # 7
                
                ele.VertexColors.Add(color)
                ele.VertexColors.Add(color)
                ele.VertexColors.Add(color)
                ele.VertexColors.Add(color)
                ele.VertexColors.Add(color)
                ele.VertexColors.Add(color)
                ele.VertexColors.Add(color)
                ele.VertexColors.Add(color)
    
                
                ele.Faces.AddFace(0, 1, 2, 3) # 0
                ele.Faces.AddFace(4, 5, 6, 7) # 1
                ele.Faces.AddFace(0, 1, 5, 4) # 2
                ele.Faces.AddFace(3, 2, 6, 7) # 3
                ele.Faces.AddFace(1, 5, 6, 2) # 4
                ele.Faces.AddFace(0, 4, 7, 3) # 5
                #ele.IsClosed()
                
            else :
                elementType.append(["FourNodeTetrahedron"]*3)
                
                if meshExpl[ index1 ][ index2 ].Vertices[0] == meshExpl[index1 + 1 ][ index2].Vertices[0] :
                    vertix1 = meshExpl[ index1 ][ index2 ].Vertices[0]
                    vertix2 = meshExpl[ index1 ][ index2 ].Vertices[1]
                    vertix3 = meshExpl[ index1 ][ index2 ].Vertices[2]
                    vertix4 = meshExpl[index1 + 1 ][ index2].Vertices[1]
                    vertix5 = meshExpl[index1 + 1 ][ index2].Vertices[2]
                    
                    vertixEle1 = [ vertix1, vertix2, vertix3, vertix4 ]
                    vertixEle2 = [ vertix1, vertix2, vertix3, vertix2 ]
                    
                    ele1 = rg.Mesh() # Tetrahedron 1
                    ele2 = rg.Mesh() # Tetrahedron 2
                    
                    ele1.Vertices.Add( vertix1 ) # 0 
                    ele1.Vertices.Add( vertix2 ) # 1
                    ele1.Vertices.Add( vertix3 ) # 2 
                    ele1.Vertices.Add( vertix4 ) # 3 
                    
                    ele1.VertexColors.Add(color)
                    ele1.VertexColors.Add(color)
                    ele1.VertexColors.Add(color)
                    ele1.VertexColors.Add(color)
                    
                    ele2.Vertices.Add( vertix1 ) # 0 
                    ele2.Vertices.Add( vertix2 ) # 1 
                    ele2.Vertices.Add( vertix3 ) # 2 
                    ele2.Vertices.Add( vertix2 ) # 3
    
                    ele2.VertexColors.Add(color)
                    ele2.VertexColors.Add(color)
                    ele2.VertexColors.Add(color)
                    ele2.VertexColors.Add(color)
                    
                    ele1.Faces.AddFace(0, 1, 4 ) # 0
                    ele1.Faces.AddFace(0, 1, 3 ) # 1
                    ele1.Faces.AddFace(0, 4, 3 ) # 2
                    ele1.Faces.AddFace(1, 3, 4 ) # 3
                    
                    ele2.Faces.AddFace(0, 1, 3 ) # 0
                    ele2.Faces.AddFace(0, 1, 2 ) # 1
                    ele2.Faces.AddFace(1, 2, 3 ) # 2
                    ele2.Faces.AddFace(0, 2, 3 ) # 3
                    
                    ele = [ ele1, ele2 ]
                    
                else :
                
                    vertix1 = meshExpl[ index1 ][ index2 ].Vertices[0]
                    vertix2 = meshExpl[ index1 ][ index2 ].Vertices[1]
                    vertix3 = meshExpl[ index1 ][ index2 ].Vertices[2]
                    vertix4 = meshExpl[index1 + 1 ][ index2].Vertices[0]
                    vertix5 = meshExpl[index1 + 1 ][ index2].Vertices[1]
                    vertix6 = meshExpl[index1 + 1 ][ index2].Vertices[2]
                    
                    vertixEle1 = [ vertix1, vertix2, vertix3, vertix6 ]
                    vertixEle2 = [ vertix4, vertix5, vertix6, vertix1 ]
                    vertixEle3 = [ vertix5, vertix6, vertix2, vertix1 ]
                    
                    vertix = [ vertixEle1, vertixEle2, vertixEle3 ]
                    
                    ele1 = rg.Mesh() # Tetrahedron 1
                    ele2 = rg.Mesh() # Tetrahedron 2
                    ele3 = rg.Mesh() # Tetrahedron 3
                    
                    ele1.Vertices.Add( vertix1 ) # 0 
                    ele1.Vertices.Add( vertix2 ) # 1
                    ele1.Vertices.Add( vertix3 ) # 2 
                    ele1.Vertices.Add( vertix6 ) # 3 
                    
                    ele1.VertexColors.Add(color)
                    ele1.VertexColors.Add(color)
                    ele1.VertexColors.Add(color)
                    ele1.VertexColors.Add(color)
                    
                    ele2.Vertices.Add( vertix4 ) # 0 
                    ele2.Vertices.Add( vertix5 ) # 1 
                    ele2.Vertices.Add( vertix6 ) # 2 
                    ele2.Vertices.Add( vertix1 ) # 3
    
                    ele2.VertexColors.Add(color)
                    ele2.VertexColors.Add(color)
                    ele2.VertexColors.Add(color)
                    ele2.VertexColors.Add(color)
                    
                    ele3.Vertices.Add( vertix5 ) # 0 
                    ele3.Vertices.Add( vertix6 ) # 1 
                    ele3.Vertices.Add( vertix2 ) # 2 
                    ele3.Vertices.Add( vertix1 ) # 3
                    
                    ele3.VertexColors.Add(color)
                    ele3.VertexColors.Add(color)
                    ele3.VertexColors.Add(color)
                    ele3.VertexColors.Add(color)
                    
                    ele1.Faces.AddFace(0, 1, 2 ) # 0
                    ele1.Faces.AddFace(0, 3, 1 ) # 1
                    ele1.Faces.AddFace(0, 3, 2 ) # 2
                    ele1.Faces.AddFace(1, 3, 2 ) # 3
                    
                    ele2.Faces.AddFace(0, 1, 2 ) # 0
                    ele2.Faces.AddFace(0, 3, 1 ) # 1
                    ele2.Faces.AddFace(0, 3, 2 ) # 2
                    ele2.Faces.AddFace(1, 3, 2 ) # 3
                    
                    ele3.Faces.AddFace(0, 1, 2 ) # 0
                    ele3.Faces.AddFace(0, 3, 1 ) # 1
                    ele3.Faces.AddFace(0, 3, 2 ) # 2
                    ele3.Faces.AddFace(1, 3, 2 ) # 3
                    
                    ele = [ ele1, ele2, ele3 ]
            
            solid.append(ele)
            Vertix.append( vertix )
    return solid, elementType

Brick, type = brick( MeshSeries, color )
# ---------- end ghpython_script_2 ----------

# ----
move_6 = Move(Geometry=graft(ghpython_script_2.Brick), Motion=unit_z_3)  # -> flatten(Geometry), Transform

# ----
# Model 0
number_slider_10 = Slider(-20, range=-20..20)
vec_10 = VectorXYZ(XComponent=number_slider_10, YComponent=0, ZComponent=0)  # -> Vector, Length
pointload_7 = Point([Point(0, 0, 10), Point(5, 0, 10), Point(0, 5, 5), Point(0, 5, 10), Point(0, 0, 5)])
vec_11 = VectorXYZ(XComponent=Slider(0, range=-20..20), YComponent=0, ZComponent=0)  # -> Vector, Length
support_6 = Point([Point(0, 0, 0), Point(5, 0, 0), Point(10, 0, 0), Point(15, 0, 0), Point(15, 5, 0), Point(10, 5, 0), Point(5, 5, 0), Point(0, 5, 0)])
shell_2 = Mesh([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])
beam_3 = Curve([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])
truss = Curve([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])
cantiliver = Curve([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])
columns_2 = Curve([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])
vec_12 = VectorXYZ(XComponent=0, YComponent=Slider(11, range=-20..20), ZComponent=0)  # -> Vector, Length
refine_3 = Refine(Mesh=shell_2, Level="2")
mesh_4 = Mesh(refine_3)
clean_2 = CombineClean(Meshes=mesh_4)
explode_4 = MeshExplode(Mesh=clean_2, Interpolate=False)  # -> flatten(Faces)

list_length = ListLength(List=pointload_7)
range_3 = Range(Domain=construct_domain, Steps=list_length)
multiplication = Multiplication(A=vec_6.Vector, B=range_3)
custom_preview = CustomPreview(Geometry=support_6, Material=ColourSwatch(SwatchColor=RGB(0, 0, 0)))

entwine_7 = Entwine(
    Branch00=explode_4,
    Branch01=beam_3,
    Branch02=truss,
    Branch03=support_6,
    Branch04=pointload_7,
    Branch05=vec_10.Vector,
    Branch06=columns_2,
    Branch07=vec_11.Vector,
    Branch08=cantiliver,
    Branch09=vec_12.Vector,
    Branch010=pointload_7,
    Branch011=multiplication,
    FlattenInputs=True)

# ----
# Model 5
number_slider_11 = Slider(-20, range=-20..20)
vec_13 = VectorXYZ(XComponent=number_slider_11, YComponent=0, ZComponent=0)  # -> Vector, Length
vec_14 = VectorXYZ(XComponent=Slider(0, range=-20..20), YComponent=0, ZComponent=0)  # -> Vector, Length
beam_4 = Curve(curve)
pointload_8 = Point(dispatch_2.ListB)
support_7 = Point(dispatch_2.ListA)

list_length_2 = ListLength(List=pointload_8)
range_4 = Range(Domain=construct_domain_2, Steps=list_length_2)
multiplication_2 = Multiplication(A=vec_7.Vector, B=range_4)

entwine_8 = Entwine(
    Branch01=beam_4,
    Branch03=support_7,
    Branch04=pointload_8,
    Branch05=vec_13.Vector,
    Branch07=vec_14.Vector,
    Branch010=pointload_8,
    Branch011=multiplication_2,
    FlattenInputs=True)

deconstruct_mesh_3 = DeconstructMesh(Mesh=ghpython_script_2.Brick)  # -> Vertices, Faces, Colours, Normals
ghpython_script_3 = GhPythonScript(x=ghpython_script_2.Brick)  # -> out, flatten(a); same code as python_2
removeduplicatepts_5 = RemoveDuplicatePts(Points=flatten(deconstruct_mesh_3.Vertices), Tolerance=0.01)
pdecon_6 = Deconstruct(Point=removeduplicatepts_5)  # -> XComponent, YComponent, ZComponent
smaller_3 = SmallerThan(FirstNumber=pdecon_6.XComponent, SecondNumber="0.1")  # -> SmallerThan, OrEqualTo
larger_than_3 = LargerThan(FirstNumber=pdecon_6.XComponent, SecondNumber=subtraction_2)  # -> LargerThan, OrEqualTo
cull_6 = CullPattern(List=removeduplicatepts_5, CullPattern=smaller_3.SmallerThan)  # -> graft(List)
cull_7 = CullPattern(List=removeduplicatepts_5, CullPattern=larger_than_3.LargerThan)  # -> graft(List)
point_4 = Point(cull_7)
pointload_9 = Point(point_4)
support_8 = Point(cull_6)
entwine_9 = Entwine(Branch03=support_8, Branch04=pointload_9, Branch05=vec_9.Vector, Branch012=ghpython_script_2.Brick, FlattenInputs=True)

dispatch_3 = Dispatch(List=removeduplicatepts_5, DispatchPattern=smaller_3.SmallerThan)  # -> ListA, ListB

point_5 = Point(dispatch_3.ListA)

stream_filter = StreamFilter(
    Gate=list,
    Stream0=entwine_7,
    Stream1=entwine_4,
    Stream2=entwine_3,
    Stream3=entwine_9,
    Stream4=entwine_2,
    Stream5=entwine_8,
    Stream6=entwine,
    Stream7=entwine_5)
explode_tree = ExplodeTree(Data=stream_filter)  # -> Branch0, Branch1, Branch2, Branch3, Branch4, Branch5, Branch6, Branch7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

pointload_10 = Point(explode_tree.Branch4)
vector = Data(explode_tree.Branch5)

support_9 = Point(explode_tree.Branch3)
shell_3 = Mesh(explode_tree.Branch0)
beam_5 = Curve(explode_tree.Branch1)
truss_2 = Curve(explode_tree.Branch2)

data_13 = Data(explode_tree.Branch6)
vector_2 = Data(explode_tree.Branch7)

data_14 = Data(explode_tree.Branch8)
vector_3 = Data(explode_tree.Branch9)

data_15 = Data(explode_tree.Branch10)
mass = Data(explode_tree.Branch11)

brick = Data(explode_tree.Branch12)

# ----
# Support
file_path_16 = FilePath("C:\GitHub\Alpaca4d\PythonScript\Pre-Processing\Element\Support\Support.py")
toggle_4 = BooleanToggle(True)
read_file_16 = ReadFile(File=file_path_16, PerLineParse=False)
point_6 = Point(support_9)
python_14 = GhPythonScript(Code=read_file_16, Pos=graft(point_6), Tx=toggle_4, Ty=Toggle(True), Tz=toggle_4, Rx=toggle_4, Ry=toggle_4, Rz=toggle_4)  # -> Out, flatten(SupportWrapper)
python_15 = GhPythonScript(x=python_14.SupportWrapper)  # -> out, a; same code as python_2
panel_10 = Panel(python_15.a)

# ----
# Linear Load
value_list = ValueList({"LocalAxis": 0, "GlobalAxis": 1}, selected="GlobalAxis")
vector_4 = Vector(vector_2)
crv = Curve(data_13)
python_16 = GhPythonScript(Code=read_file_5, Force=vector_4, Element=crv, Orientation=value_list)  # -> Out, flatten(BeamUniformLoad)

# ----
# Linear Load
value_list_2 = ValueList({"LocalAxis": 0, "GlobalAxis": 1}, selected="GlobalAxis")
vector_5 = Vector(vector_3)
crv_2 = Curve(data_14)
python_17 = GhPythonScript(Code=read_file_5, Force=vector_5, Element=crv_2, Orientation=value_list_2)  # -> Out, flatten(BeamUniformLoad)

# ----
# Point Load
file_path_17 = FilePath("C:\GitHub\Alpaca4d\PythonScript\Pre-Processing\Load\PointLoad.py")
read_file_17 = ReadFile(File=file_path_17, PerLineParse=False)
vector_6 = Vector(expr("x*0", Vector(2.518385542, -6.656153768, 0)))
vector_7 = Vector(vector)
point_7 = Point(pointload_10)
python_18 = GhPythonScript(Code=read_file_17, Force=vector_7, Moment=vector_6, Pos=point_7)  # -> Out, flatten(LoadWrapper)

# ----
# MassLoad
num_2 = Number(mass)
pt_2 = Point(data_15)
path_5 = FilePath("C:\GitHub\Alpaca4d\PythonScript\Pre-Processing\Load\MassLoad.py")
file_5 = ReadFile(File=path_5, PerLineParse=False)
python_19 = GhPythonScript(Code=file_5, NodalMass=num_2, Pos=pt_2)  # -> Out, flatten(Mass)

# ----
# meshToShell
mesh_5 = Mesh(shell_3)
file_path_18 = FilePath("C:\GitHub\Alpaca4d\PythonScript\Pre-Processing\Element\MeshToShell\MeshToShell.py")
read_file_18 = ReadFile(File=file_path_18, PerLineParse=False)
python_20 = GhPythonScript(Code=read_file_18, Mesh=mesh_5, Colour=ColourSwatch(SwatchColor=RGB(242, 19, 19)), CrossSection=python_10.CrossSection)  # -> Out, flatten(ShellWrapper)

tri = Triangulate(Mesh=mesh_5)  # -> Mesh, Count
explode_5 = MeshExplode(Mesh=mesh_5, Interpolate=False)  # -> flatten(Faces)

crv_3 = Curve(truss_2)

# ----
# LineToBeam
file_path_19 = FilePath("C:\GitHub\Alpaca4d\PythonScript\Pre-Processing\Element\LineToBeam\LineToBeam.py")
read_file_19 = ReadFile(File=file_path_19, PerLineParse=False)
crv_4 = Curve(beam_5)
python_21 = GhPythonScript(Code=read_file_19, Line=crv_4, CrossSection=python_13.CrossSection)  # -> Out, flatten(BeamWrapper)

data_16 = Data([python_16.BeamUniformLoad, python_17.BeamUniformLoad, python_18.LoadWrapper])

# ----
# LineToTruss
list_3 = ValueList({"Truss": 0, "Beam": 1}, selected="Truss")
swatch = ColourSwatch(SwatchColor=RGB(255, 200, 0))
python_22 = GhPythonScript(Code=read_file_19, Line=crv_3, CrossSection=python_8.CrossSection, OrientSection="0", BeamType=list_3)  # -> Out, flatten(BeamWrapper)

# ----
# Solid
swatch_2 = ColourSwatch(SwatchColor=RGB(0, 72, 255))
python_23 = GhPythonScript(Code=read_file_8, Brick=brick, Colour=swatch_2, NDMaterial=python_5.NDMaterial)  # -> Out, flatten(SolidWrapper)

item = ListItem(List=python_23.SolidWrapper, Index=0, Wrap=True)  # -> Item, Item1
python_24 = GhPythonScript(x=item.Item)  # -> out, simplify(a); same code as python_2
python_25 = GhPythonScript(x=python_24.a)  # -> out, simplify(a); same code as python_2
python_26 = GhPythonScript(x=python_25.a)  # -> out, simplify(a); same code as python_2
merge_2 = Merge(Data1=python_20.ShellWrapper, Data2=python_21.BeamWrapper, Data3=python_22.BeamWrapper, Data4=python_23.SolidWrapper)
panel_11 = Panel(python_26.a)
clean_tree = CleanTree(RemoveNulls=True, RemoveInvalid=True, RemoveEmpty=False, Tree=merge_2)
clean_tree_2 = CleanTree(RemoveNulls=True, RemoveInvalid=True, RemoveEmpty=False, Tree=python_14.SupportWrapper)
clean_tree_3 = CleanTree(RemoveNulls=True, RemoveInvalid=True, RemoveEmpty=False, Tree=data_16)
clean_tree_4 = CleanTree(RemoveNulls=True, RemoveInvalid=True, RemoveEmpty=False, Tree=python_19.Mass)

# ----
# Assemble
file_path_20 = FilePath("C:\GitHub\Alpaca4d\PythonScript\Pre-Processing\Assemble\Assemble.py")
read_file_20 = ReadFile(File=file_path_20, PerLineParse=False)
python_27 = GhPythonScript(
    Code=read_file_20,
    Element=flatten(clean_tree),
    Support=flatten(clean_tree_2),
    Load=flatten(clean_tree_3),
    Mass=flatten(clean_tree_4))  # -> Out, AlpacaModel, MassOfStructure

panel_12 = Panel(python_27.MassOfStructure)
data_17 = Data(python_27.AlpacaModel)  # disabled
data_18 = Data(python_27.AlpacaModel)

# ----
# modelView
# da fare a cluster
# OK!
file_path_21 = FilePath("C:\GitHub\Alpaca4d\PythonScript\Post-Processing\modelView\modelView.py")  # disabled
boolean_toggle_4 = BooleanToggle(False)  # disabled
read_file_21 = ReadFile(File=file_path_21, PerLineParse=False)  # disabled
python_28 = GhPythonScript(
    Code=read_file_21,
    AlpacaModel=data_17,
    ModelExstrud=boolean_toggle,
    Load=boolean_toggle_4,
    Support=boolean_toggle_2,
    NodalMass=boolean_toggle_3)  # -> ModelView, LineModel, ForceDisplay, Support, LocalAxis, TagNode, TagEle, Mass; disabled
explode_tree_2 = ExplodeTree(Data=python_28.LocalAxis)  # -> Branch0, Branch1, Branch2, Branch3; disabled
explode_tree_3 = ExplodeTree(Data=python_28.LineModel)  # -> Branch0, Branch1; disabled
number_slider_12 = Slider(3, range=0..10)  # disabled
geo = Geometry(python_28.ModelView)  # disabled
geo_2 = Geometry(geo)  # disabled
explode_tree_4 = ExplodeTree(Data=simplify(python_28.TagNode))  # -> Branch0, Branch1; disabled
explode_tree_5 = ExplodeTree(Data=simplify(python_28.TagEle))  # -> Branch0, Branch1; disabled
explode_tree_6 = ExplodeTree(Data=simplify(python_28.Mass))  # -> Branch0, Branch1; disabled
colour_swatch = ColourSwatch(SwatchColor=RGB(164, 252, 0))  # disabled
colour_swatch_2 = ColourSwatch(SwatchColor=RGB(176, 32, 32))  # disabled
colour_swatch_3 = ColourSwatch(SwatchColor=RGB(107, 106, 102))  # disabled
colour_swatch_4 = ColourSwatch(SwatchColor=RGB(252, 0, 0))  # disabled
explode_tree_7 = ExplodeTree(Data=python_28.ForceDisplay)  # -> Branch0, Branch1; disabled
colour_swatch_5 = ColourSwatch(SwatchColor=RGB(255, 0, 0))  # disabled
colour_swatch_6 = ColourSwatch(SwatchColor=RGB(0, 245, 53))  # disabled
colour_swatch_7 = ColourSwatch(SwatchColor=RGB(0, 55, 255))  # disabled
colour_swatch_8 = ColourSwatch(SwatchColor=RGB(25, 0, 255))  # disabled
custom_preview_2 = CustomPreview(Geometry=python_28.Support, Material=colour_swatch)  # disabled
vector_display_ex = VectorDisplayEx(Point=explode_tree_7.Branch0, Vector=explode_tree_7.Branch1, Colour=colour_swatch_2, Width=2)  # disabled
vector_display_ex_2 = VectorDisplayEx(Point=explode_tree_2.Branch0, Vector=explode_tree_2.Branch1, Colour=colour_swatch_4, Width=2)  # disabled
vector_display_ex_3 = VectorDisplayEx(Point=explode_tree_2.Branch0, Vector=explode_tree_2.Branch2, Colour=colour_swatch_6, Width=2)  # disabled
vector_display_ex_4 = VectorDisplayEx(Point=explode_tree_2.Branch0, Vector=explode_tree_2.Branch3, Colour=colour_swatch_7, Width=2)  # disabled
dot_display = DotDisplay(Point=explode_tree_6.Branch0, Colour=colour_swatch_3, Size=explode_tree_6.Branch1)  # disabled
tag = TextTag(Location=explode_tree_4.Branch0, Text=explode_tree_4.Branch1, Colour=colour_swatch_5)  # disabled
tag_2 = TextTag(Location=explode_tree_5.Branch0, Text=explode_tree_5.Branch1, Colour=colour_swatch_8)  # disabled

# ----
# Modal Analyses
path_6 = FilePath("C:\GitHub\Alpaca4d\PythonScript\Analyses\DynamicAnalysis\initializeModalAnalyses.py")
file_6 = ReadFile(File=path_6, PerLineParse=False)
analyze_3 = GhPythonScript(Code=file_6, AlpacaModel=data_18, NumVibrationModes="3")  # -> Out, AlpacaModalOutput, Frequency, Period

data_19 = Data(python_27.AlpacaModel)

# ----
# EarthQuake Analyses
path_7 = FilePath("C:\GitHub\Alpaca4d\PythonScript\Analyses\EarthQuakeAnalysis\BM68elc.acc")
path_8 = FilePath("C:\GitHub\Alpaca4d\PythonScript\Analyses\EarthQuakeAnalysis\initializeEarthQuakeAnalysis.py")
list_4 = ValueList({"x": 1, "y": 2, "z": 3}, selected="x")
file_7 = ReadFile(File=path_8, PerLineParse=False)
analyze_4 = GhPythonScript(
    Code=file_7,
    AlpacaModel=data_19,
    TmaxAnalyses="2",
    GroundMotionDirection=list_4,
    GroundMotionValues=sine,
    GroundMotionTimeStep=series_3,
    GroundMotionFactor="1",
    TimeStepIncrement="0.005",
    Damping=0.02,
    NewmarkGamma=0.5,
    NewmarkBeta=0.25)  # -> Out, AlpacaGroundmotionOutput, MaxDisplacement, MinDisplacement

file_8 = ReadFile(File=path_7, PerLineParse=False)
graph = QuickGraph(sine, SortOrder=0)
split = TextSplit(Text=file_8, Separators=" ")
division = Division(A=split, B="1")
clean_3 = CleanTree(RemoveNulls=True, RemoveInvalid=True, RemoveEmpty=invert(False), Tree=division)
lng = ListLength(List=clean_3)
multiplication_3 = Multiplication(A=lng, B="0.01")
earthquake_file_seconds = Panel(multiplication_3)

analyze_5 = GhPythonScript(Code=file, AlpacaModel=python_27.AlpacaModel)  # -> Out, AlpacaStaticOutput, MaxDisplacement
analyze_6 = GhPythonScript(Code=file_2, AlpacaModel=python_27.AlpacaModel)  # -> Out, AlpacaStaticOutput; disabled
series_6 = Series(Start=0, Step="0.01", Count=lng)
panel_13 = Panel(python_28.ForceDisplay)  # disabled
curve_direction = GhPythonScript(Thickness=number_slider_12)  # -> out; inputs Crv: list of Curve, RGB: list of Color; disabled
# ---------- curve_direction: Python ----------
from ghpythonlib.componentbase import executingcomponent as component
import Grasshopper, GhPython
import System
import Rhino as rh
import rhinoscriptsyntax as rs
import Rhino.Geometry as rg


class CurveColor(component):

    def RunScript(self,Crv,Thickness,RGB):
        self.C = Crv
        self.RGB = RGB
        self.t = Thickness
        if not self.C: return
            
    def DrawViewportWires(self,arg):
        if not  self.C: return
        for curve, color in zip( self.C, self.RGB ):
            arg.Display.DrawCurve(curve, color,self.t)
# ---------- end curve_direction ----------
panel_14 = Panel(analyze_4.MinDisplacement)
custom_preview_3 = CustomPreview(Geometry=explode_tree_3.Branch0, Material=explode_tree_3.Branch1)  # disabled
# we can skip some data point. We don't need to read all of them. This can help to make it faster.
# 
# OR
# 
# We can read ALL the files and show only some output.
panel_15 = Panel(analyze_4.MaxDisplacement)
panel_16 = Panel(analyze_4.AlpacaGroundmotionOutput)
data_20 = Data(analyze_3.AlpacaModalOutput)

# ---- group: MODAL ANALYSIS
ghpython_script_4 = GhPythonScript(
    Code=file_3,
    AlpacaModalOutput=data_20,
    NumberMode=Slider(1, range=0..10),
    Speed=Slider(1, range=1..50),
    Animate=Toggle(False),
    Reset=Button(),
    ExtrudedModel=Toggle(True))  # -> Out, ModelDisp, simplify(ModelCurve), simplify(ModelShell), simplify(ModelSolid)

# ----
merge_3 = Merge(Data1=analyze_5.AlpacaStaticOutput, Data2=analyze_6.AlpacaStaticOutput)  # -> flatten(Result)
merge_4 = Merge(Data1=analyze_5.AlpacaStaticOutput, Data2=analyze_6.AlpacaStaticOutput)  # -> flatten(Result); disabled

number_of_line_to_skip_2 = Slider(1, range=1..100)
ghpython_script_5 = GhPythonScript(
    Code=file_4,
    OpenSeesOutputWrapper=analyze_4.AlpacaGroundmotionOutput,
    Speed=number_of_line_to_skip_2,
    Animate=Toggle(False),
    Reset=Button(),
    Scale=Slider(1000, range=0..1000),
    ExtrudedModel=Toggle(True))  # -> Out, ModelDisp, ModelCurve, ModelShell, ModelSolid, Trans
list_5 = ValueList({"tx": 0, "ty": 1, "tz": 2, "txyz": 3}, selected="tx")
cluster = Cluster(gate=list_5)

# ----
# Forces view
file_path_22 = FilePath("C:\GitHub\Alpaca4d\PythonScript\Post-Processing\shellForceView\shellForceView.py")
read_file_22 = ReadFile(File=file_path_22, PerLineParse=False)
list_6 = ValueList({"Fx": 0, "Fy": 1, "Fz": 2, "Mx": 3, "My": 4, "Mz": 5}, selected="Fx")
python_29 = GhPythonScript(Code=read_file_22, AlpacaStaticOutput=analyze_5.AlpacaStaticOutput, ViewForce=list_6)  # -> Shell, ForceValue
list_7 = ValueList({"Face1": 0, "Face2": 1, "Face3": 2, "Face4": 3}, selected="Face1")
cluster_2 = Cluster_2(mesh=python_29.Shell, list=python_29.ForceValue, index=list_7)

# ---- group: Reaction Forces
# Reactions
number_slider_13 = Slider(10, range=0..100)  # disabled
file_path_23 = FilePath("C:\GitHub\Alpaca4d\PythonScript\Post-Processing\reaction\reaction.py")  # disabled
toggle_5 = BooleanToggle(True)  # disabled
read_file_23 = ReadFile(File=file_path_23, PerLineParse=False)  # disabled
toggle_6 = BooleanToggle(True)  # disabled
python_30 = GhPythonScript(
    Code=read_file_23,
    AlpacaStaticOutput=analyze_5.AlpacaStaticOutput,
    ReactionForcesView=toggle_6,
    ReactionMomentsView=toggle_5,
    Scale=number_slider_13)  # -> Out, TagPoints, ReactionForce, ReactionMoment, View; disabled
reactionforce = ReactionForce(python_30.ReactionForce)  # disabled
tagpoints = TagPoints(python_30.TagPoints)  # disabled
reactionmoment = ReactionMoment(python_30.ReactionMoment)  # disabled
explode_tree_8 = ExplodeTree(Data=python_30.View)  # -> Branch0, Branch1, Branch2, Branch3, Branch4, Branch5, Branch6; disabled
colour_swatch_9 = ColourSwatch(SwatchColor=RGB(252, 0, 0))  # disabled
colour_swatch_10 = ColourSwatch(SwatchColor=RGB(0, 55, 255))  # disabled
vector_display_ex_5 = VectorDisplayEx(
    Point=explode_tree_8.Branch0,
    Vector=[explode_tree_8.Branch3, explode_tree_8.Branch2, explode_tree_8.Branch1],
    Colour=colour_swatch_9,
    Width=2)  # disabled
vector_display_ex_6 = VectorDisplayEx(
    Point=explode_tree_8.Branch0,
    Vector=[explode_tree_8.Branch6, explode_tree_8.Branch5, explode_tree_8.Branch4],
    Colour=colour_swatch_10,
    Width=2)  # disabled

# ---- group: Beam Forces
# CDS valor
number_slider_14 = Slider(10, range=0..10)  # disabled
file_path_24 = FilePath("C:\GitHub\Alpaca4d\PythonScript\Post-Processing\beamForces\beamForces.py")  # disabled
# beam Component
read_file_24 = ReadFile(File=file_path_24, PerLineParse=False)  # disabled
python_31 = GhPythonScript(Code=read_file_24, AlpacaStaticOutput=analyze_5.AlpacaStaticOutput)  # -> Out, TagElement, N, V1, V2, Mt, M1, M2; disabled

# ---- group: Cds Visualisation
# CDS view
number_slider_15 = Slider(1.412, range=0.001..10)
file_path_25 = FilePath("C:\GitHub\Alpaca4d\PythonScript\Post-Processing\cdsView\cdsView.py")
read_file_25 = ReadFile(File=file_path_25, PerLineParse=False)
list_8 = ValueList({"N", "V1", "V2", "M2", "M1", "Mt"}, selected="N")
python_32 = GhPythonScript(Code=read_file_25, AlpacaStaticOutput=analyze_5.AlpacaStaticOutput, SectionForces=list_8)

# ---- group: shell Forces
# Forces valor
file_path_26 = FilePath("C:\GitHub\Alpaca4d\PythonScript\Post-Processing\shellForces\shellForces.py")  # disabled
read_file_26 = ReadFile(File=file_path_26, PerLineParse=False)  # disabled
python_33 = GhPythonScript(Code=read_file_26, AlpacaStaticOutput=analyze_5.AlpacaStaticOutput)  # -> Out, TagElement, Fx, Fy, Fz, Mx, My, Mz; disabled

# ---- group: Shell Stress Visualisation
# Stress view & valor
file_path_27 = FilePath("C:\GitHub\Alpaca4d\PythonScript\Post-Processing\shellStressView\shellStressView.py")
read_file_27 = ReadFile(File=file_path_27, PerLineParse=False)
list_9 = ValueList({"pxx": 0, "pyy": 1, "pxy": 2, "txz": 3, "tyz": 4, "mxx": 5, "myy": 6, "mxy": 7}, selected="pxx")
python_34 = GhPythonScript(Code=read_file_27, AlpacaStaticOutput=analyze_5.AlpacaStaticOutput, StressView=list_9)  # -> Shell, StressValue
# da riguardare per i valori
# Brick component
cluster_3 = Cluster_2(mesh=python_34.Shell, list=python_34.StressValue, index=0)

# ---- group: nD Stress Visualisation
# Stress view & valor
file_path_28 = FilePath("C:\GitHub\Alpaca4d\PythonScript\Post-Processing\brickStress\brickStress.py")  # disabled
read_file_28 = ReadFile(File=file_path_28, PerLineParse=False)  # disabled
list_10 = ValueList({"sigmaX": 0, "sigmaY": 1, "sigmaZ": 2, "tauXY": 3, "tauXZ": 4, "tauYZ": 5}, selected="tauYZ")  # disabled
python_35 = GhPythonScript(Code=read_file_28, AlpacaStaticOutput=analyze_6.AlpacaStaticOutput, StressView=list_10)  # -> Brick, StressValue; disabled
cluster_4 = Cluster_2(mesh=python_35.Brick, list=python_35.StressValue, index=0)  # disabled

# ----
# deformedModelView
# OK!
number_slider_16 = Slider(357, range=0..10000)
file_path_29 = FilePath("C:\GitHub\Alpaca4d\PythonScript\Post-Processing\defModelView\defModelView.py")
read_file_29 = ReadFile(File=file_path_29, PerLineParse=False)
python_36 = GhPythonScript(Code=read_file_29, AlpacaStaticOutput=merge_3, Scale=number_slider_16, ModelExstrud=Toggle(False))  # -> Out, ModelDisp, simplify(ModelCurve), simplify(ModelShell), simplify(ModelSolid)
list_11 = ValueList({"tx": 0, "ty": 1, "tz": 2, "txyz": 3}, selected="txyz")

data_21 = Data(analyze_4.AlpacaGroundmotionOutput)  # disabled
ghpython_script_6 = GhPythonScript(
    AlpacaGroundmotionOutput=data_21,
    speed=number_of_line_to_skip,
    Animate=toggle_2,
    Reset=button,
    scale=number_slider_7,
    ExtrudedModel=toggle_3)  # -> ModelDisp, ModelCurve, ModelShell, ModelSolid, trans; inputs AlpacaGroundmotionOutput: list, speed: Int32; disabled
# ---------- ghpython_script_6: Python ----------
import Rhino.Geometry as rg
import math as mt
import ghpythonlib.treehelpers as th
import Grasshopper as gh
import sys
import rhinoscriptsyntax as rs
import Rhino.Display as rd
from scriptcontext import doc
import time


def GroundMotionView(AlpacaGroundmotionOutput, speed, Animate, Reset, scale, ExtrudedModel):

    def alphat( E, G, I, At ):
        return (E*I)/(G*At)
    
    ## Spostamenti e rotazioni ##
    def spostu( x, L, uI, uJ ):
        return -(-L*uI + uI*x - uJ*x)/L
        
    def spostv( x, L, vI, vJ, thetaI, thetaJ, alphay ):
        return (L**3*thetaI*x + L**3*vI - 2*L**2*thetaI*x**2 - L**2*thetaJ*x**2 + 6*L*alphay*thetaI*x - 6*L*alphay*thetaJ*x + 12*L*alphay*vI + L*thetaI*x**3 + L*thetaJ*x**3 - 3*L*vI*x**2 + 3*L*vJ*x**2 - 6*alphay*thetaI*x**2 + 6*alphay*thetaJ*x**2 - 12*alphay*vI*x + 12*alphay*vJ*x + 2*vI*x**3 - 2*vJ*x**3)/(L*(L**2 + 12*alphay))
        
    def spostw( x, L, wI, wJ, psiI, psiJ, alphaz ):
        return -(L**3*psiI*x - L**3*wI - 2*L**2*psiI*x**2 - L**2*psiJ*x**2 - 6*L*alphaz*psiI*x + 6*L*alphaz*psiJ*x + 12*L*alphaz*wI + L*psiI*x**3 + L*psiJ*x**3 + 3*L*wI*x**2 - 3*L*wJ*x**2 + 6*alphaz*psiI*x**2 - 6*alphaz*psiJ*x**2 - 12*alphaz*wI*x + 12*alphaz*wJ*x - 2*wI*x**3 + 2*wJ*x**3)/(L*(L**2 - 12*alphaz))
        
    def thetaz(x, L, vI, vJ, thetaI, thetaJ, alphay): 
        return (L**3*thetaI - 4*L**2*thetaI*x - 2*L**2*thetaJ*x + 12*L*alphay*thetaI + 3*L*thetaI*x**2 + 3*L*thetaJ*x**2 - 6*L*vI*x + 6*L*vJ*x - 12*alphay*thetaI*x + 12*alphay*thetaJ*x + 6*vI*x**2 - 6*vJ*x**2)/(L*(L**2 + 12*alphay))
        
    def phix(x, L, phiI, phiJ):
        return -(-L*phiI + phiI*x - phiJ*x)/L
    
    def psiy(x, L, wI, wJ, psiI, psiJ, alphaz): 
        return (L**3*psiI - 4*L**2*psiI*x - 2*L**2*psiJ*x - 12*L*alphaz*psiI + 3*L*psiI*x**2 + 3*L*psiJ*x**2 + 6*L*wI*x - 6*L*wJ*x + 12*alphaz*psiI*x - 12*alphaz*psiJ*x - 6*wI*x**2 + 6*wJ*x**2)/(L*(L**2 - 12*alphaz))
        
    def gammay( L, vI, vJ, thetaI, thetaJ, alphay): 
    
        return (L*thetaI + L*thetaJ + 2*vI - 2*vJ)/(L*(L**2 + 12*alphay))
        
    def gammaz( L, wI, wJ, psiI, psiJ, alphaz):
    
        return -(L*psiI + L*psiJ - 2*wI + 2*wJ)/(L*(L**2 - 12*alphaz))
    
    ##------------------------------------------------------------------------- --##
    
    def scaleAutomatic( Num , Den ):
        if Den < 0.1 :
            return Num
        else :
            return Num*1/Den
    
    def linspace(a, b, n=100):
        if n < 2:
            return b
        diff = (float(b) - a)/(n - 1)
        return [diff * i + a  for i in range(n)]
    
    ## Funzione rettangolo ##
    def AddRectangleFromCenter(plane, width, height):
        a = plane.PointAt(-width * 0.5, -height * 0.5 )
        b = plane.PointAt(-width * 0.5,  height * 0.5 )
        c = plane.PointAt( width * 0.5,  height * 0.5 )
        d = plane.PointAt( width * 0.5,  -height * 0.5 )
        #rectangle = rg.PolylineCurve( [a, b, c, d, a] )
        rectangle  = [a, b, c, d] 
        return rectangle
    
    ## Funzione cerchio ##
    def AddCircleFromCenter( plane, radius):
        t = linspace( 0 , 1.80*mt.pi, 15 )
        a = []
        for ti in t:
            x = radius*mt.cos(ti)
            y = radius*mt.sin(ti)
            a.append( plane.PointAt( x, y ) )
        #circle = rg.PolylineCurve( a )
        circle  = a 
        return circle
    
    def AddIFromCenter(plane, Bsup, tsup, Binf, tinf, H, ta, yg):
        #-------------------1---------2 #
        p1 = plane.PointAt( -(yg - tinf), ta/2 )
        p2 = plane.PointAt( -(yg - tinf), Binf/2 )
        p3 = plane.PointAt( -yg, Binf/2 )
        p4 = plane.PointAt( -yg, -Binf/2 )
        p5 = plane.PointAt( -(yg - tinf), -Binf/2 ) 
        p6 = plane.PointAt( -(yg - tinf), -ta/2 )
        p7 = plane.PointAt( (H - yg - tsup), -ta/2)
        p8 = plane.PointAt( (H - yg - tsup), -Bsup/2 )
        p9 = plane.PointAt( (H - yg ), -Bsup/2 )
        p10 = plane.PointAt( (H - yg ), Bsup/2 )
        p11 = plane.PointAt( (H - yg - tsup), Bsup/2 )
        p12 = plane.PointAt( (H - yg - tsup), ta/2 )
    
        wirframe  = [ p1, p2, p3, p4, p5, p6, p7, p8, p9, p10, p11, p12 ] 
        return wirframe
    
    def defShellQuad( ele, node, nodeDisp, scaleDef ):
        
        eleTag = ele[0]
        eleNodeTag = ele[1]
        color = ele[2][2]
        thick = ele[2][1]
        #print( eleNodeTag )
        #print( eleNodeTag )
        index1 = eleNodeTag[0] 
        index2 = eleNodeTag[1] 
        index3 = eleNodeTag[2] 
        index4 = eleNodeTag[3] 
        
        trasl1 = nodeDisp.get( index1 , "never")[0]
        rotate1 = nodeDisp.get( index1 , "never")[1]
        
        trasl2 = nodeDisp.get( index2 , "never")[0]
        rotate2 = nodeDisp.get( index2 , "never")[1]
        
        trasl3 = nodeDisp.get( index3 , "never")[0]
        rotate3 = nodeDisp.get( index3 , "never")[1]
        
        trasl4 = nodeDisp.get( index4 , "never")[0]
        rotate4 = nodeDisp.get( index4 , "never")[1]
        
        ## CREO IL MODELLO DEFORMATO  ##
        
        pointDef1 = rg.Point3d.Clone( node.get( index1 , "never") )
        pointDef2 = rg.Point3d.Clone( node.get( index2 , "never") )
        pointDef3 = rg.Point3d.Clone( node.get( index3 , "never") )
        pointDef4 = rg.Point3d.Clone( node.get( index4 , "never") )
        #print( index1 - 1)
        #print( nodeDisp )
        vectortrasl1 = rg.Transform.Translation( rg.Vector3d(trasl1.X, trasl1.Y, trasl1.Z)*scaleDef )
        pointDef1.Transform( vectortrasl1 )
        vectortrasl2 = rg.Transform.Translation( rg.Vector3d(trasl2.X, trasl2.Y, trasl2.Z)*scaleDef )
        pointDef2.Transform( vectortrasl2 )
        vectortrasl3 = rg.Transform.Translation( rg.Vector3d(trasl3.X, trasl3.Y, trasl3.Z)*scaleDef )
        pointDef3.Transform( vectortrasl3 )
        vectortrasl4 = rg.Transform.Translation( rg.Vector3d(trasl4.X, trasl4.Y, trasl4.Z)*scaleDef )
        pointDef4.Transform( vectortrasl4 )
        shellDefModel = rg.Mesh()
        shellDefModel.Vertices.Add( pointDef1 ) #0
        shellDefModel.Vertices.Add( pointDef2 ) #1
        shellDefModel.Vertices.Add( pointDef3 ) #2
        shellDefModel.Vertices.Add( pointDef4 ) #3
        
        
        shellDefModel.Faces.AddFace(0, 1, 2, 3)
        colour = rs.CreateColor( color[0], color[1], color[2] )
        shellDefModel.VertexColors.CreateMonotoneMesh( colour )
    
        vt = shellDefModel.Vertices
        shellDefModel.FaceNormals.ComputeFaceNormals()
        fid,MPt = shellDefModel.ClosestPoint(vt[0],0.01)
        normalFace = shellDefModel.FaceNormals[fid]
        vectormoltiplicate = rg.Vector3d.Multiply( -normalFace, thick/2 )
        trasl = rg.Transform.Translation( vectormoltiplicate )
        moveShell = rg.Mesh.DuplicateMesh(shellDefModel)
        moveShell.Transform( trasl )
        extrudeShell = rg.Mesh.Offset( moveShell, thick, True, normalFace)
        return  [shellDefModel,[trasl1, trasl2, trasl3, trasl4], [rotate1, rotate2, rotate3, rotate4], extrudeShell ]
    
    def defShellTriangle( ele, node, nodeDisp, scaleDef ):
        
        eleTag = ele[0]
        eleNodeTag = ele[1]
        color = ele[2][1]
        index1 = eleNodeTag[0] - 1
        index2 = eleNodeTag[1] - 1
        index3 = eleNodeTag[2] - 1
        
        trasl1 = nodeDisp.get( index1 , "never")[0]
        rotate1 = nodeDisp.get( index1  , "never")[1]
        
        trasl2 = nodeDisp.get( index2 , "never")[0]
        rotate2 = nodeDisp.get( index2 , "never")[1]
        
        trasl3 = nodeDisp.get( index3 , "never")[0]
        rotate3 = nodeDisp.get( index3 , "never")[1]
        
        ## CREO IL MODELLO DEFORMATO  ##
        pointDef1 = rg.Point3d.Clone( node.get( index1 , "never") )
        pointDef2 = rg.Point3d.Clone( node.get( index2 , "never") )
        pointDef3 = rg.Point3d.Clone( node.get( index3 , "never") )
        vectortrasl1 = rg.Transform.Translation( rg.Vector3d(trasl1.X, trasl1.Y, trasl1.Z)*scaleDef )
        pointDef1.Transform( vectortrasl1 )
        vectortrasl2 = rg.Transform.Translation( rg.Vector3d(trasl2.X, trasl2.Y, trasl2.Z)*scaleDef )
        pointDef2.Transform( vectortrasl2 )
        vectortrasl3 = rg.Transform.Translation( rg.Vector3d(trasl3.X, trasl3.Y, trasl3.Z)*scaleDef )
        pointDef3.Transform( vectortrasl3 )
        shellDefModel = rg.Mesh()
        shellDefModel.Vertices.Add( pointDef1 ) #0
        shellDefModel.Vertices.Add( pointDef2 ) #1
        shellDefModel.Vertices.Add( pointDef3 ) #2
        
        shellDefModel.Faces.AddFace(0, 1, 2)
        colour = rs.CreateColor( color[0], color[1], color[2] )
        vt = shellDefModel.Vertices
        shellDefModel.FaceNormals.ComputeFaceNormals()
        fid,MPt = shellDefModel.ClosestPoint(vt[0],0.01)
        normalFace = shellDefModel.FaceNormals[fid]
        vectormoltiplicate = rg.Vector3d.Multiply( -normalFace, thick/2 )
        trasl = rg.Transform.Translation( vectormoltiplicate )
        moveShell = rg.Mesh.DuplicateMesh(shellDefModel)
        moveShell.Transform( trasl )
        extrudeShell = rg.Mesh.Offset( moveShell, thick, True, normalFace)
        return  [shellDefModel,[trasl1, trasl2, trasl3], [rotate1, rotate2, rotate3], extrudeShell ]
    
    def defSolid( ele, node, nodeDisp, scaleDef ):
        
        eleTag = ele[0]
        eleNodeTag = ele[1]
        color = ele[2][1]
        thick = ele[2][1]
        #print( eleNodeTag )
        index1 = eleNodeTag[0] - 1
        index2 = eleNodeTag[1] - 1
        index3 = eleNodeTag[2] - 1
        index4 = eleNodeTag[3] - 1
        index5 = eleNodeTag[4] - 1
        index6 = eleNodeTag[5] - 1
        index7 = eleNodeTag[6] - 1
        index8 = eleNodeTag[7] - 1
        
        trasl1 = nodeDisp.get( index1 , "never")
        trasl2 = nodeDisp.get( index2 , "never")
        trasl3 = nodeDisp.get( index3 , "never")
        trasl4 = nodeDisp.get( index4 , "never")
        trasl5 = nodeDisp.get( index5 , "never")
        trasl6 = nodeDisp.get( index6 , "never")
        trasl7 = nodeDisp.get( index7 , "never")
        trasl8 = nodeDisp.get( index8 , "never")
        
        ## CREO IL MODELLO DEFORMATO  ##
        pointDef1 = rg.Point3d.Clone( node.get( index1 , "never") )
        pointDef2 = rg.Point3d.Clone( node.get( index2 , "never") )
        pointDef3 = rg.Point3d.Clone( node.get( index3 , "never") )
        pointDef4 = rg.Point3d.Clone( node.get( index4 , "never") )
        pointDef5 = rg.Point3d.Clone( node.get( index5 , "never") )
        pointDef6 = rg.Point3d.Clone( node.get( index6 , "never") )
        pointDef7 = rg.Point3d.Clone( node.get( index7 , "never") )
        pointDef8 = rg.Point3d.Clone( node.get( index8 , "never") )
        vectortrasl1 = rg.Transform.Translation( rg.Vector3d(trasl1.X, trasl1.Y, trasl1.Z)*scaleDef )
        pointDef1.Transform( vectortrasl1 )
        vectortrasl2 = rg.Transform.Translation( rg.Vector3d(trasl2.X, trasl2.Y, trasl2.Z)*scaleDef )
        pointDef2.Transform( vectortrasl2 )
        vectortrasl3 = rg.Transform.Translation( rg.Vector3d(trasl3.X, trasl3.Y, trasl3.Z)*scaleDef )
        pointDef3.Transform( vectortrasl3 )
        vectortrasl4 = rg.Transform.Translation( rg.Vector3d(trasl4.X, trasl4.Y, trasl4.Z)*scaleDef )
        pointDef4.Transform( vectortrasl4 )
        vectortrasl5 = rg.Transform.Translation( rg.Vector3d(trasl5.X, trasl5.Y, trasl5.Z)*scaleDef )
        pointDef5.Transform( vectortrasl1 )
        vectortrasl6 = rg.Transform.Translation( rg.Vector3d(trasl6.X, trasl6.Y, trasl6.Z)*scaleDef )
        pointDef6.Transform( vectortrasl2 )
        vectortrasl7 = rg.Transform.Translation( rg.Vector3d(trasl7.X, trasl7.Y, trasl7.Z)*scaleDef )
        pointDef7.Transform( vectortrasl3 )
        vectortrasl8 = rg.Transform.Translation( rg.Vector3d(trasl8.X, trasl8.Y, trasl8.Z)*scaleDef )
        pointDef8.Transform( vectortrasl4 )
        
        shellDefModel = rg.Mesh()
        shellDefModel.Vertices.Add( pointDef1 ) #0
        shellDefModel.Vertices.Add( pointDef2 ) #1
        shellDefModel.Vertices.Add( pointDef3 ) #2
        shellDefModel.Vertices.Add( pointDef4 ) #3
        shellDefModel.Vertices.Add( pointDef5 ) #4
        shellDefModel.Vertices.Add( pointDef6 ) #5
        shellDefModel.Vertices.Add( pointDef7 ) #6
        shellDefModel.Vertices.Add( pointDef8 ) #7
    
        shellDefModel.Faces.AddFace(0, 1, 2, 3)
        shellDefModel.Faces.AddFace(4, 5, 6, 7)
        shellDefModel.Faces.AddFace(0, 1, 5, 4)
        shellDefModel.Faces.AddFace(1, 2, 6, 5)
        shellDefModel.Faces.AddFace(2, 3, 7, 6)
        shellDefModel.Faces.AddFace(3, 0, 4, 7)
        
        colour = rs.CreateColor( color[0], color[1], color[2] )
        shellDefModel.VertexColors.CreateMonotoneMesh( colour )
        return  [shellDefModel,[trasl1, trasl2, trasl3,trasl4, trasl5, trasl6, trasl7, trasl8 ]]
    
    def defTetraSolid( ele, node, nodeDisp, scaleDef ):
        
        eleTag = ele[0]
        eleNodeTag = ele[1]
        color = ele[2][1]
        #print( eleNodeTag )
        index1 = eleNodeTag[0] - 1
        index2 = eleNodeTag[1] - 1
        index3 = eleNodeTag[2] - 1
        index4 = eleNodeTag[3] - 1
        
        trasl1 = nodeDisp.get( index1 , "never")
        trasl2 = nodeDisp.get( index2 , "never")
        trasl3 = nodeDisp.get( index3 , "never")
        trasl4 = nodeDisp.get( index4 , "never")
        
        ## CREO IL MODELLO DEFORMATO  ##
        pointDef1 = rg.Point3d.Clone( node.get( index1 , "never") )
        pointDef2 = rg.Point3d.Clone( node.get( index2 , "never") )
        pointDef3 = rg.Point3d.Clone( node.get( index3 , "never") )
        pointDef4 = rg.Point3d.Clone( node.get( index4 , "never") )
        
        vectortrasl1 = rg.Transform.Translation( rg.Vector3d(trasl1.X, trasl1.Y, trasl1.Z)*scaleDef )
        pointDef1.Transform( vectortrasl1 )
        vectortrasl2 = rg.Transform.Translation( rg.Vector3d(trasl2.X, trasl2.Y, trasl2.Z)*scaleDef )
        pointDef2.Transform( vectortrasl2 )
        vectortrasl3 = rg.Transform.Translation( rg.Vector3d(trasl3.X, trasl3.Y, trasl3.Z)*scaleDef )
        pointDef3.Transform( vectortrasl3 )
        vectortrasl4 = rg.Transform.Translation( rg.Vector3d(trasl4.X, trasl4.Y, trasl4.Z)*scaleDef )
        pointDef4.Transform( vectortrasl4 )
    
        shellDefModel = rg.Mesh()
        shellDefModel.Vertices.Add( pointDef1 ) #0
        shellDefModel.Vertices.Add( pointDef2 ) #1
        shellDefModel.Vertices.Add( pointDef3 ) #2
        shellDefModel.Vertices.Add( pointDef4 ) #3
        
        
        shellDefModel.Faces.AddFace( 0, 1, 2 )
        shellDefModel.Faces.AddFace( 0, 1, 3 )
        shellDefModel.Faces.AddFace( 1, 2, 3 )
        shellDefModel.Faces.AddFace( 0, 2, 3 )
        colour = rs.CreateColor( color[0], color[1], color[2] )
        shellDefModel.VertexColors.CreateMonotoneMesh( colour )
        
        return  [shellDefModel,[trasl1, trasl2, trasl3, trasl4]]
    ## node e nodeDisp son dictionary ##
    def defValueTimoshenkoBeam( ele, node, nodeDisp, scaleDef ):
        #---------------- WORLD PLANE ----------------------#
        WorldPlane = rg.Plane.WorldXY
        #--------- Propriety TimoshenkoBeam  ----------------#
        TagEle = ele[0]
        propSection = ele[2]
        indexStart = ele[1][0]
        indexEnd = ele[1][1]
        #print( indexStart, indexEnd )
        color = propSection[12]
        E = propSection[1]
        G = propSection[2]
        A = propSection[3]
        Avz = propSection[4]
        Avy = propSection[5]
        Jxx = propSection[6]
        Iy = propSection[7]
        Iz = propSection[8]
        #---- traslation and rotation index start & end ------- #
        traslStart = nodeDisp.get( indexStart , "never")[0]
        rotateStart = nodeDisp.get( indexStart , "never")[1]
        traslEnd = nodeDisp.get( indexEnd , "never")[0]
        rotateEnd = nodeDisp.get( indexEnd , "never")[1]
        ##-------------------------------------------- ------------##
        pointStart = node.get( indexStart  , "never")
        pointEnd = node.get( indexEnd  , "never")
        line = rg.LineCurve( pointStart, pointEnd )
        #-------------------------versor ---------------------------#
        axis1 =  rg.Vector3d( propSection[9][0][0], propSection[9][0][1], propSection[9][0][2]  )
        axis2 =  rg.Vector3d( propSection[9][1][0], propSection[9][1][1], propSection[9][1][2]  )
        axis3 =  rg.Vector3d( propSection[9][2][0], propSection[9][2][1], propSection[9][2][2]  )
        versor = [ axis1, axis2, axis3 ] 
        #---------- WORLD PLANE on point start of line ---------------#
        traslPlane = rg.Transform.Translation( pointStart.X, pointStart.Y, pointStart.Z )
        WorldPlane.Transform( traslPlane )
        #-------------------------------------------------------------#
        planeStart = rg.Plane(pointStart, axis1, axis2 )
        #planeStart = rg.Plane(pointStart, axis3 )
        localPlane = planeStart
        xform = rg.Transform.ChangeBasis( WorldPlane, localPlane )
        localTraslStart = rg.Point3d( traslStart )
        vectorTrasform = rg.Transform.TransformList( xform, [ traslStart, rotateStart, traslEnd, rotateEnd ] )
        #print( vectorTrasform[0] )
        localTraslStart = vectorTrasform[0]
        uI1 = localTraslStart.X # spostamento in direzione dell'asse rosso 
        uI2 = localTraslStart.Y # spostamento in direzione dell'asse verde
        uI3 = localTraslStart.Z # spostamento linea d'asse
        localRotStart = vectorTrasform[1]
        rI1 = localRotStart.X # 
        rI2 = localRotStart.Y # 
        rI3 = localRotStart.Z # 
        localTraslEnd = vectorTrasform[2]
        uJ1 = localTraslEnd.X # spostamento in direzione dell'asse rosso 
        uJ2 = localTraslEnd.Y # spostamento in direzione dell'asse verde
        uJ3 = localTraslEnd.Z # spostamento linea d'asse
        localRotEnd = vectorTrasform[3]
        rJ1 = localRotEnd[0] #  
        rJ2 = localRotEnd[1]  # 
        rJ3 = localRotEnd[2]  # 
        ##------------------ displacement value -------------------------##
        Length = rg.Curve.GetLength( line )
        divideDistance = 0.5
        DivCurve = line.DivideByLength( divideDistance, True )
        if DivCurve == None:
            DivCurve = [ 0, Length]
            
        #s = linspace(0,Length, len(PointsDivLength))
        AlphaY = alphat( E, G, Iy, Avz )
        AlphaZ = alphat( E, G, Iz, Avy )
        
        globalTransVector = []
        globalRotVector = []
        defPoint = []
        defSection = []
        #----------------------- local to global-------------------------#
        xform2 = xform.TryGetInverse()
        #----------------------------------------------------------------#
        for index, x in enumerate(DivCurve):
            beamPoint = line.PointAt(DivCurve[index]) 
            ## SPOSTAMENTO IN DIREZIONE DELL' ASSE 3 ##
            u3 = spostu(x, Length, uI3, uJ3)
            u3Vector = u3*axis3
            ## SPOSTAMENTO IN DIREZIONE DELL' ASSE 1 ##
            v1 =  spostv(x, Length, uI1, uJ1, rI2, rJ2, AlphaY)
            v1Vector = v1*axis1 
            ## SPOSTAMENTO IN DIREZIONE DELL' ASSE 2 ##
            v2 =  spostw(x, Length, uI2, uJ2, rI1, rJ1, AlphaZ)
            v2Vector = v2*axis2 
            
            ## RISULTANTE SPOSTAMENTI ##
            transResult = v1Vector + v2Vector + u3Vector
            
            r2x =  thetaz(x, Length, uI1, uJ1, rI2, rJ2, AlphaY)
            r1x =  psiy(x, Length, uI2, uJ2, rI1, rJ1, AlphaZ)
            r3x = phix(x, Length, rI3, rJ3)
            
            rotResult = r1x*axis1 + r2x*axis2 + r3x*axis3
            
            trasl = rg.Transform.Translation( transResult*scaleDef )
            beamPoint.Transform( trasl )
            defPoint.append( beamPoint )
            
            sectionPlane = rg.Plane( beamPoint, axis1, axis2 )
            sectionPlane.Rotate( scaleDef*r1x, axis1, beamPoint )
            sectionPlane.Rotate( scaleDef*r2x, axis2, beamPoint )
            sectionPlane.Rotate( scaleDef*r3x, axis3, beamPoint )
            if dimSection[0] == 'rectangular' :
                width, height = dimSection[1], dimSection[2]
                section = AddRectangleFromCenter( sectionPlane, width, height )
                defSection.append( section )
            elif dimSection[0] == 'circular' :
                radius1  = dimSection[1]/2
                radius2  = dimSection[1]/2 - dimSection[2]
                section1 = AddCircleFromCenter( sectionPlane, radius1 )
                if (radius1 - radius2 ) == 0 :
                    defSection.append( section1 )
                else :
                    section2 = AddCircleFromCenter( sectionPlane, radius2 )
                    defSection.append( [ section1, section2 ] )
            elif dimSection[0] == 'doubleT' :
                Bsup = dimSection[1]
                tsup = dimSection[2]
                Binf = dimSection[3]
                tinf = dimSection[4]
                H =  dimSection[5]
                ta =  dimSection[6]
                yg =  dimSection[7]
                section = AddIFromCenter( sectionPlane, Bsup, tsup, Binf, tinf, H, ta, yg )
                defSection.append( section )
            elif dimSection[0] == 'Generic' :
                radius  = dimSection[1]
                section = AddCircleFromCenter( sectionPlane, radius )
                defSection.append( section )
        
            globalTrasl = rg.Point3d( transResult ) 
            globalTrasl.Transform(xform2[1]) 
            globalTrasl.Transform(xform)
            globalTransVector.append( globalTrasl )
    
       
        defpolyline = rg.PolylineCurve( defPoint )
    
        if dimSection[0] == 'circular' :
            radius1  = dimSection[1]/2
            radius2  = dimSection[1]/2 - dimSection[2]
            if (radius1 - radius2 ) == 0:
                meshdef = meshLoft3( defSection,  color )
    
            else :
                defSection1 = [row[0] for row in defSection ]
                defSection2 = [row[1] for row in defSection ]
                meshdef = meshLoft3( defSection1,  color )
                meshdef.Append( meshLoft3( defSection2,  color ) )
                #print( meshdef )
    
        else  :
            meshdef = meshLoft3( defSection,  color )
        return  [  defpolyline, meshdef ,  globalTransVector, globalRotVector ] 
    
    ## node e nodeDisp son dictionary ##
    def defTruss( ele, node, nodeDisp, scale ):
        WorldPlane = rg.Plane.WorldXY
        TagEle = ele[0]
        propSection = ele[2]
        color = propSection[12]
        indexStart = ele[1][0]
        indexEnd = ele[1][1]
        #print( indexStart, indexEnd )
        E = propSection[1]
        A = propSection[3]
        
        traslStart = nodeDisp.get( indexStart , "never")
        traslEnd = nodeDisp.get( indexEnd  , "never")
        if len( traslStart ) == 2:
            traslStart = nodeDisp.get( indexStart  , "never")[0]
            traslEnd = nodeDisp.get( indexEnd  , "never")[0]
        pointStart = node.get( indexStart  , "never")
        pointEnd = node.get( indexEnd  , "never")
        #print( traslStart[1] )
        line = rg.LineCurve( pointStart,  pointEnd )
    
        axis1 =  rg.Vector3d( propSection[9][0][0], propSection[9][0][1], propSection[9][0][2]  )
        axis2 =  rg.Vector3d( propSection[9][1][0], propSection[9][1][1], propSection[9][1][2]  )
        axis3 =  rg.Vector3d( propSection[9][2][0], propSection[9][2][1], propSection[9][2][2]  )
        versor = [ axis1, axis2, axis3 ] 
        #---------- WORLD PLANE on point start of line ---------------#
        traslPlane = rg.Transform.Translation( pointStart.X, pointStart.Y, pointStart.Z )
        WorldPlane.Transform( traslPlane )
        #-------------------------------------------------------------#
        planeStart = rg.Plane(pointStart, axis1, axis2 )
        #planeStart = rg.Plane(pointStart, axis3 )
        localPlane = planeStart
        xform = rg.Transform.ChangeBasis( WorldPlane, localPlane )
        localTraslStart = rg.Point3d( traslStart )
        vectorTrasform = rg.Transform.TransformList( xform, [ traslStart , traslEnd ] )
        #print( vectorTrasform[0] )
        localTraslStart = vectorTrasform[0]
        uI1 = localTraslStart.X # spostamento in direzione dell'asse rosso 
        uI2 = localTraslStart.Y # spostamento in direzione dell'asse verde
        uI3 = localTraslStart.Z # spostamento linea d'asse
        localTraslEnd = vectorTrasform[1]
        uJ1 = localTraslEnd.X # spostamento in direzione dell'asse rosso 
        uJ2 = localTraslEnd.Y # spostamento in direzione dell'asse verde
        uJ3 = localTraslEnd.Z # spostamento linea d'asse
        ##-------------- displacement value -------------------------##
        Length = rg.Curve.GetLength( line )
        divideDistance = 0.5
        DivCurve = line.DivideByLength( divideDistance, True )
        if DivCurve == None:
            DivCurve = [ 0, Length]
        defPoint = []
        defSection = []
        globalTransVector = []
        #----------------------- local to global-------------------------#
        xform2 = xform.TryGetInverse()
        #----------------------------------------------------------------#
        for index, x in enumerate(DivCurve):
            beamPoint = line.PointAt(DivCurve[index]) 
            ## SPOSTAMENTO IN DIREZIONE DELL' ASSE 3 ##
            u3 = spostu(x, Length, uI3, uJ3)
            u3Vector = u3*axis3
            ## SPOSTAMENTO IN DIREZIONE DELL' ASSE 1 ##
            v1 =  x*( uJ1 - uI1 )/Length + uI1
            v1Vector = v1*axis1 
            ## SPOSTAMENTO IN DIREZIONE DELL' ASSE 2 ##
            v2 =  x*( uJ2 - uI2 )/Length + uI2
            v2Vector = v2*axis2 
            ## RISULTANTE SPOSTAMENTI ##
            transResult = v1Vector + v2Vector + u3Vector
            trasl = rg.Transform.Translation( transResult*scale )
            beamPoint.Transform( trasl )
            defPoint.append( beamPoint )
            
            sectionPlane = rg.Plane( beamPoint, axis1, axis2 )
            if dimSection[0] == 'rectangular' :
                width, height = dimSection[1], dimSection[2]
                section = AddRectangleFromCenter( sectionPlane, width, height )
                defSection.append( section )
            elif dimSection[0] == 'circular' :
                radius1  = dimSection[1]/2
                radius2  = dimSection[1]/2 - dimSection[2]
                section1 = AddCircleFromCenter( sectionPlane, radius1 )
                if (radius1 - radius2 ) == 0 :
                    defSection.append( section1 )
                else :
                    section2 = AddCircleFromCenter( sectionPlane, radius2 )
                    defSection.append( [ section1, section2 ] )
            elif dimSection[0] == 'doubleT' :
                Bsup = dimSection[1]
                tsup = dimSection[2]
                Binf = dimSection[3]
                tinf = dimSection[4]
                H =  dimSection[5]
                ta =  dimSection[6]
                yg =  dimSection[7]
                section = AddIFromCenter( sectionPlane, Bsup, tsup, Binf, tinf, H, ta, yg )
                defSection.append( section )
            elif dimSection[0] == 'Generic' :
                radius  = dimSection[1]
                section = AddCircleFromCenter( sectionPlane, radius )
                defSection.append( section )
        
            globalTrasl = rg.Point3d( transResult ) 
            globalTrasl.Transform(xform2[1]) 
            globalTrasl.Transform(xform)
            globalTransVector.append( globalTrasl )
    
       
        defpolyline = rg.PolylineCurve( defPoint )
    
        if dimSection[0] == 'circular' :
            radius1  = dimSection[1]/2
            radius2  = dimSection[1]/2 - dimSection[2]
            if (radius1 - radius2 ) == 0:
                meshdef = meshLoft3( defSection,  color )
    
            else :
                defSection1 = [row[0] for row in defSection ]
                defSection2 = [row[1] for row in defSection ]
                meshdef = meshLoft3( defSection1,  color )
                meshdef.Append( meshLoft3( defSection2,  color ) )
                #print( meshdef )
    
        else  :
            meshdef = meshLoft3( defSection,  color )
        return  [ defpolyline, meshdef, globalTransVector] 
    ## Mesh from close section eith gradient color ##
    
    def meshLoft3( point, color ):
        meshElement = rg.Mesh()
        meshEle = rg.Mesh()
        pointSection1 = point
        #print( point )
        for i in range(0,len(pointSection1)):
            for j in range(0, len(pointSection1[0])):
                vertix = pointSection1[i][j]
                #print( type(vertix) )
                meshEle.Vertices.Add( vertix ) 
                #meshEle.VertexColors.Add( color[0],color[1],color[2] );
        k = len(pointSection1[0])
        for i in range(0,len(pointSection1)-1):
            for j in range(0, len(pointSection1[0])):
                if j < k-1:
                    index1 = i*k + j
                    index2 = (i+1)*k + j
                    index3 = index2 + 1
                    index4 = index1 + 1
                elif j == k-1:
                    index1 = i*k + j
                    index2 = (i+1)*k + j
                    index3 = (i+1)*k
                    index4 = i*k
                meshEle.Faces.AddFace(index1, index2, index3, index4)
                #rs.ObjectColor(scyl,(255,0,0))
        colour = rs.CreateColor( color[0], color[1], color[2] )
        meshEle.VertexColors.CreateMonotoneMesh( colour )
        meshElement = meshEle
        
        return meshElement
    
    def updateComponent(interval):
        
        ## Updates this component, similar to using a grasshopper timer 
        
        # Define callback action
        def callBack(e):
            ghenv.Component.ExpireSolution(False)
            
        # Get grasshopper document
        ghDoc = ghenv.Component.OnPingDocument()
        
        # Schedule this component to expire
        ghDoc.ScheduleSolution(interval,gh.Kernel.GH_Document.GH_ScheduleDelegate(callBack)) # Note that the first input here is how often to update the component (in milliseconds)
    
    
    #-------------------------------------------------------------------------------------#
    path = AlpacaGroundmotionOutput[0].strip()
    EleOut = AlpacaGroundmotionOutput[1]
    point = AlpacaGroundmotionOutput[2]
    
    
    timeStep = []
    displacement = []
    
    start = time.clock()  
    
    
    with open(path, 'r') as f:
        lines = f.readlines()
        for n, line in enumerate(lines):
            if (n % speed) == 0:
                #print( n % speed )
                line = line.strip().split(" ")
                timeStep.append( line[0] )
                displacementTemp = line[1:]
                n = 6
                displacementTime = [displacementTemp[i:i + n] for i in range(0, len(displacementTemp), n)]
                displacement.append(displacementTime)
    
    
    
    
    
    # I change the List Structure to have an ouput
    # this change will not affect the work done before
    
    newDisplacement = [[row[i] for row in displacement] for i in range(len(displacement[0]))]
    
    trans = []
    rot = []
    for nodeDispCollection in newDisplacement:
        transTemp = []
        rotTemp = []
        for nodeDisp in nodeDispCollection:
            transTemp.append(rg.Vector3d(float(nodeDisp[0]),float(nodeDisp[1]),float(nodeDisp[2])))
            rotTemp.append(rg.Vector3d(float(nodeDisp[3]),float(nodeDisp[4]),float(nodeDisp[5])))
        trans.append(transTemp)
        rot.append(rotTemp)
    
    #for item in newDisplacement
    
    trans = th.list_to_tree(trans)
    rot = th.list_to_tree(rot)
    
    
    
    
    #print(time.clock() - start)
    
    if "myCounter" not in globals() or Reset:
        myCounter = 0
    
    if Animate and not Reset:
        if myCounter >= len(displacement) - 1:
            myCounter = 0
        else:
            myCounter += 1
        updateComponent(1)
    
    
    
    
    stepValue = displacement[myCounter]
    #print( stepValue[0][0] )
    pointDef = []
    for indexPoint, value in enumerate(stepValue):
        tagPoint = indexPoint  + 1
        #print( tagPoint )
        traslX = float(value[0])
        traslY = float(value[1])
        traslZ = float(value[2])
        rotX = float(value[3]) 
        rotY = float(value[4])
        rotZ = float(value[5])
        pointDef.append([ tagPoint, [ rg.Point3d( traslX, traslY, traslZ ), rg.Point3d( rotX, rotY, rotZ ) ]])
    timePointDef = dict( pointDef )
    
    
    nodeValue = []
    #ShellOut = AlpacaGroundmotionOutputputWrapper[4]
    
    pointWrapper = []
    
    for value in point:
        index = value[0] 
        #print( index )
        pointWrapper.append( [index, rg.Point3d(value[1][0],value[1][1],value[1][2]) ] )
    
    ## Dict. for point ##
    pointWrapperDict = dict( pointWrapper )
    ####
    scaleDef = scale
    
    modelCurve = []
    ShellDefModel = []
    ExtrudedView = rg.Mesh()
    modelDisp = []
    
    traslBeamValue = []
    rotBeamValue = []
    
    traslShellValue = []
    rotShellValue = []
    ExtrudedShell = []
    
    SolidDefModel = []
    traslSolidValue = []
    
    #print( timePointDef[A] )
    for ele in EleOut :
        eleType = ele[2][0]
        nNode = len( ele[1] )
        
        if eleType == 'ElasticTimoshenkoBeam' :
            
            dimSection = ele[2][10]
            valueTBeam = defValueTimoshenkoBeam( ele, pointWrapperDict, timePointDef, scaleDef )
            defpolyline = valueTBeam[0]
            meshdef = valueTBeam[1]
            globalTrans = valueTBeam[2]
            globalRot = valueTBeam[3]
            traslBeamValue.append( globalTrans ) 
            rotBeamValue.append( globalRot )
            modelCurve.append( defpolyline )
            modelDisp.append( defpolyline )
            # estrusione della beam #
            ExtrudedView.Append( meshdef )
            #doc.Objects.AddMesh( meshdef )
        elif eleType == 'Truss' :
            dimSection = ele[2][10]
            #print( color )
            valueTruss = defTruss( ele, pointWrapperDict, timePointDef, scaleDef )
            defpolyline = valueTruss[0]
            meshdef = valueTruss[1]
            globalTrans = valueTruss[2]
            traslBeamValue.append( globalTrans ) 
            modelCurve.append( defpolyline )
            modelDisp.append( defpolyline )
            ExtrudedView.Append( meshdef )
            #doc.Objects.AddMesh( meshdef )
    
        elif nNode == 4 and eleType != 'FourNodeTetrahedron':
            shellDefModel = defShellQuad( ele, pointWrapperDict, timePointDef, scaleDef )
            ShellDefModel.append( shellDefModel[0] )
            traslShellValue.append( shellDefModel[1] )
            rotShellValue.append( shellDefModel[2] )
            extrudeShell = shellDefModel[3]
            ExtrudedView.Append( extrudeShell )
    
            
        elif nNode == 3:
            #print( nNode )
            shellDefModel = defShellTriangle( ele, pointWrapperDict, timePointDef, scaleDef )
            ShellDefModel.append( shellDefModel[0] )
            traslShellValue.append( shellDefModel[1] )
            rotShellValue.append( shellDefModel[2] )
            extrudeShell = shellDefModel[3]
            ExtrudedView.Append( extrudeShell )
            
        elif nNode == 8:
            solidDefModel = defSolid( ele, pointWrapperDict, timePointDef, scaleDef)
            SolidDefModel.append( solidDefModel[0] )
            doc.Objects.AddMesh( solidDefModel[0] )
            traslSolidValue.append( solidDefModel[1] )
            ExtrudedView.Append( solidDefModel[0] )
            
        elif  eleType == 'FourNodeTetrahedron' :
            #print(ele)
            solidDefModel = defTetraSolid( ele, pointWrapperDict, timePointDef, scaleDef )
            SolidDefModel.append( solidDefModel[0] )
            traslSolidValue.append( solidDefModel[1] )
            ExtrudedView.Append( solidDefModel[0] )
    
    # Max Beam #
    flattenTrasl = []
    for valuetrasl in traslBeamValue:
        for value in valuetrasl:
            flattenTrasl.append( value )
    
    TraslX = [row[0] for row in flattenTrasl ]
    TraslY = [row[1] for row in flattenTrasl ]
    TraslZ = [row[2] for row in flattenTrasl ]
    
    #              txMax          tyMax         tzMax
    tMax = [  max(TraslX)  ,  max(TraslY) ,  max(TraslZ)  ]
    #              txMin          tyMin         tzMin
    tMin = [   min(TraslX) ,  min(TraslY) , min(TraslZ)  ]
    
    
    
    def gradientJet(value, valueMax, valueMin):
    
        listcolo = [[0, 0, 102 ],
                    [0, 0, 255],
                    [0, 64, 255],
                    [0, 128, 255],
                    [0, 191, 255],
                    [0, 255, 255],
                    [0, 255, 191],
                    [0, 255, 128],
                    [0, 255, 64],
                    [0, 255, 0],
                    [64, 255, 0],
                    [128, 255, 0],
                    [191, 255, 0],
                    [255, 255, 0],
                    [255, 191, 0],
                    [255, 128, 0],
                    [255, 64, 0],
                    [255, 0, 0],
                    [230, 0, 0],
                    [204, 0, 0]]
    
        #domain = linspace( valueMin,  valueMax, len( listcolo ) )
        n = len( listcolo )
        domain = linspace( valueMin, valueMax, n)
        
        for i in range(1,n):
            if  domain[i-1] <= value <= domain[i]:
                return listcolo[ i-1 ]
            elif  valueMax <= value <= valueMax + 0.00001 :
                return listcolo[ -1 ]
            elif  valueMin - 0.00000000001 <= value <= valueMin  :
                return listcolo[ 0 ]
    
    ## Mesh from close section eith gradient color ##
    def meshLoft4( point, value, valueMax, valueMin ):
        meshEle = rg.Mesh()
        for i in range(0,len(point)):
            color = gradientJet( value[i], valueMax, valueMin )
            for j in range(0, len(point[0])):
                vertix = point[i][j]
                meshEle.Vertices.Add( vertix ) 
                meshEle.VertexColors.Add( color[0],color[1],color[2] );
        k = len(point[0])
        for i in range(0,len(point)-1):
            for j in range(0, len(point[0])):
                if j < k-1:
                    index1 = i*k + j
                    index2 = (i+1)*k + j
                    index3 = index2 + 1
                    index4 = index1 + 1
                elif j == k-1:
                    index1 = i*k + j
                    index2 = (i+1)*k + j
                    index3 = (i+1)*k
                    index4 = i*k
                meshEle.Faces.AddFace(index1, index2, index3, index4)
        return meshEle
    
    
    
    if ExtrudedModel == False or ExtrudedModel == None :
        ModelDisp  = None
        ModelCurve = th.list_to_tree([ modelCurve , traslBeamValue ])
        ModelShell = th.list_to_tree([ ShellDefModel , traslShellValue ])
        ModelSolid = th.list_to_tree([ SolidDefModel , traslSolidValue ])
    else  :
        ModelDisp = ExtrudedView
        ModelCurve = None
        ModelShell = None
        ModelSolid = None
    return ModelDisp, ModelCurve, ModelShell, ModelSolid, trans


checkData = True

if not AlpacaGroundmotionOutput:
    checkData = False
    msg = "input 'AlpacaGroundmotionOutput' failed to collect data"
    ghenv.Component.AddRuntimeMessage(gh.Kernel.GH_RuntimeMessageLevel.Warning, msg)


if checkData != False:
    ModelDisp, ModelCurve, ModelShell, ModelSolid, trans = GroundMotionView(AlpacaGroundmotionOutput, speed, Animate, Reset, scale, ExtrudedModel)
# ---------- end ghpython_script_6 ----------
# ---- group: brick Displacement
python_37 = GhPythonScript(Code=read_file_14, AlpacaStaticOutput=analyze_6.AlpacaStaticOutput)  # -> Out, TagElement, Trans; disabled

# ---- group: Shell Displacement
python_38 = GhPythonScript(Code=read_file_12, AlpacaStaticOutput=analyze_5.AlpacaStaticOutput)  # -> Out, TagElement, Trans, Rot; disabled

# ---- group: Beam Displacement
python_39 = GhPythonScript(Code=read_file_11, AlpacaStaticOutput=analyze_5.AlpacaStaticOutput, NumberResults=number_slider_8)  # -> Out, TagElement, LocalTrans, LocalRot, GlobalTrans, GlobalRot; disabled

# ---- group: NodeDisp
python_40 = GhPythonScript(Code=read_file_13, AlpacaStaticOutput=merge_4)  # -> Out, Points, Trans, Rot; disabled

# ----
# displacement Component
cluster_5 = Cluster(
    tree_2=simplify(python_36.ModelCurve),
    tree=simplify(python_36.ModelShell),
    tree_3=simplify(python_36.ModelSolid),
    gate=list_11)
# shell Component
panel_17 = Panel(python_33.Mz)  # disabled
deconstruct_domain_2 = DeconstructDomain(Domain=cluster)  # -> Start, End
data_recorder = DataRecorder(deconstruct_domain_2.End, DataLimit=-10, RecordData=True)
graph_2 = QuickGraph(data_recorder, SortOrder=0)

# ----
# OK!
file_path_30 = FilePath("C:\GitHub\Alpaca4d\PythonScript\Post-Processing\disassembleModel\disassembleModel.py")  # disabled
read_file_30 = ReadFile(File=file_path_30, PerLineParse=False)  # disabled

# ---- group: disassemble Model
python_41 = GhPythonScript(Code=read_file_30, AlpacaModel=python_27.AlpacaModel)  # -> ModelView, ModelViewExtruded, Points, Support, Load, Material, Section; disabled

# ----
panel_18 = Panel(python_41.ModelViewExtruded)  # disabled

# ==== cluster Cluster
tree = ClusterInput()
tree_2 = ClusterInput()
gate = ClusterInput()
tree_3 = ClusterInput()
tree_statistics = TreeStatistics(Tree=tree_2)  # -> Paths, Length, Count
tree_statistics_2 = TreeStatistics(Tree=tree)  # -> Paths, Length, Count
cull_index = CullIndex(List=tree_statistics.Paths, Indices="0", Wrap=True)
tree_statistics_3 = TreeStatistics(Tree=tree_3)  # -> Paths, Length, Count
construct_path = ConstructPath(Indices="0")
cull_index_2 = CullIndex(List=tree_statistics_2.Paths, Indices="0", Wrap=True)
construct_path_2 = ConstructPath(Indices="0")
cull_index_3 = CullIndex(List=tree_statistics_3.Paths, Indices="0", Wrap=True)
tree_branch = TreeBranch(Tree=tree_2, Path=construct_path, MaintainPaths=True)
tree_branch_2 = TreeBranch(Tree=tree_2, Path=cull_index, MaintainPaths=True)
construct_path_3 = ConstructPath(Indices="0")
tree_branch_3 = TreeBranch(Tree=tree, Path=construct_path_2, MaintainPaths=True)
tree_branch_4 = TreeBranch(Tree=tree, Path=cull_index_2, MaintainPaths=True)
list_length = ListLength(List=tree_branch_2)
tree_branch_5 = TreeBranch(Tree=tree_3, Path=construct_path_3, MaintainPaths=True)
tree_branch_6 = TreeBranch(Tree=tree_3, Path=cull_index_3, MaintainPaths=True)
deconstruct_vector = DeconstructVector(Vector=tree_branch_4)  # -> XComponent, YComponent, ZComponent
vector_length = VectorLength(Vector=tree_branch_4)
divide_curve = DivideCurve(Curve=tree_branch, Count=flatten(list_length), Kinks=False)  # -> Points, Tangents, simplify(Parameters)
deconstruct_vector_2 = DeconstructVector(Vector=tree_branch_6)  # -> XComponent, YComponent, ZComponent
vector_length_2 = VectorLength(Vector=tree_branch_6)
stream_filter = StreamFilter(
    Gate=gate,
    Stream0=deconstruct_vector.XComponent,
    Stream1=deconstruct_vector.YComponent,
    Stream2=deconstruct_vector.ZComponent,
    Stream3=vector_length)
stream_filter_2 = StreamFilter(
    Gate=gate,
    Stream0=deconstruct_vector_2.XComponent,
    Stream1=deconstruct_vector_2.YComponent,
    Stream2=deconstruct_vector_2.ZComponent,
    Stream3=vector_length_2)
deconstruct_vector_3 = DeconstructVector(Vector=tree_branch_2)  # -> XComponent, YComponent, ZComponent
vector_length_3 = VectorLength(Vector=tree_branch_2)
merge = Merge(Data1=tree_branch_2, Data2=tree_branch_4, Data3=tree_branch_6)  # -> flatten(Result)
deconstruct_vector_4 = DeconstructVector(Vector=merge)  # -> XComponent, YComponent, ZComponent
stream_filter_3 = StreamFilter(
    Gate=gate,
    Stream0=deconstruct_vector_3.XComponent,
    Stream1=deconstruct_vector_3.YComponent,
    Stream2=deconstruct_vector_3.ZComponent,
    Stream3=vector_length_3)
vector_length_4 = VectorLength(Vector=merge)
stream_filter_4 = StreamFilter(
    Gate=gate,
    Stream0=deconstruct_vector_4.XComponent,
    Stream1=deconstruct_vector_4.YComponent,
    Stream2=deconstruct_vector_4.ZComponent,
    Stream3=vector_length_4)
bounds = Bounds(Numbers=flatten(stream_filter_4))
entwine = Entwine(Branch00=stream_filter_3, Branch01=stream_filter, Branch02=stream_filter_2, FlattenInputs=True)  # -> flatten(Result)
deconstruct_domain = DeconstructDomain(Domain=bounds)  # -> Start, End
bounds_2 = Bounds(Numbers=entwine)
shatter = Shatter(Curve=graft(tree_branch), Parameters=divide_curve.Parameters)  # -> simplify(graft(Segments))
domain = ClusterOutput(bounds_2)
gradient = Gradient(
    LowerLimit=deconstruct_domain.Start,
    UpperLimit=deconstruct_domain.End,
    Parameter=stream_filter_3,
    stops=[0.103: RGB(0, 0, 255), 0.22: RGB(0, 170, 255), 0.305: RGB(0, 255, 255), 0.398: RGB(0, 255, 188), 0.504: RGB(0, 255, 106), 0.605: RGB(91, 255, 0), 0.699: RGB(184, 255, 0), 0.799: RGB(255, 255, 0), 0.898: RGB(255, 170, 0)])
gradient_2 = Gradient(
    LowerLimit=deconstruct_domain.Start,
    UpperLimit=deconstruct_domain.End,
    Parameter=stream_filter,
    stops=[0.103: RGB(0, 0, 255), 0.22: RGB(0, 170, 255), 0.305: RGB(0, 255, 255), 0.398: RGB(0, 255, 188), 0.504: RGB(0, 255, 106), 0.605: RGB(91, 255, 0), 0.699: RGB(184, 255, 0), 0.799: RGB(255, 255, 0), 0.898: RGB(255, 170, 0)])
gradient_3 = Gradient(
    LowerLimit=deconstruct_domain.Start,
    UpperLimit=deconstruct_domain.End,
    Parameter=stream_filter_2,
    stops=[0.103: RGB(0, 0, 255), 0.22: RGB(0, 170, 255), 0.305: RGB(0, 255, 255), 0.398: RGB(0, 255, 188), 0.504: RGB(0, 255, 106), 0.605: RGB(91, 255, 0), 0.699: RGB(184, 255, 0), 0.799: RGB(255, 255, 0), 0.898: RGB(255, 170, 0)])
number_slider = Slider(3, range=0..10)
curve = Curve(flatten(shatter))
mesh_colours = MeshColours(Mesh=graft(tree_branch_5), Colours=gradient_3)
mesh_colours_2 = MeshColours(Mesh=graft(tree_branch_3), Colours=gradient_2)
custom_preview = CustomPreview(Geometry=curve, Material=flatten(gradient))

# ==== cluster Cluster_2
index = ClusterInput()
list = ClusterInput()
list_item = ListItem(List=list, Index=index, Wrap=True)
bounds = Bounds(Numbers=flatten(list_item))
deconstruct_domain = DeconstructDomain(Domain=bounds)  # -> Start, End
gradient = Gradient(
    LowerLimit=deconstruct_domain.Start,
    UpperLimit=deconstruct_domain.End,
    Parameter=list_item,
    stops=[0.103: RGB(0, 0, 255), 0.22: RGB(0, 170, 255), 0.305: RGB(0, 255, 255), 0.398: RGB(0, 255, 188), 0.504: RGB(0, 255, 106), 0.605: RGB(91, 255, 0), 0.699: RGB(184, 255, 0), 0.799: RGB(255, 255, 0), 0.898: RGB(255, 170, 0)])
mesh = ClusterInput()
mesh_colours = MeshColours(Mesh=graft(mesh), Colours=gradient)
