# Grasshopper definition 200401_GHPython_DrawViewportWires_02.gh (Grasshopper 1.0.7)

# ---- group: Draw 2D Text in Screen Space
# Create by
# Anders - BIG IDeas
panel = Panel("""Ham:
- Foo
- Bar
- Jeff
- Britta
- 100%""")
pt = Point(Point(100, 100, 0))
dst = DrawScreenText(Text=panel, Color=ColourSwatch(SwatchColor=RGB(0, 0, 0)), Height=Slider(30, range=0..30), Point=pt, Font="Iosevka")
# ---------- dst: Python ----------
from ghpythonlib.componentbase import executingcomponent as component
import Rhino as rc

ghenv.Component.Name = "DrawScreenText"
ghenv.Component.NickName = "DST"

class MyComponent(component):
    
    def RunScript(self,Text,Color,Height,Point,Font):
        self.text = Text
        self.color = Color
        self.height = Height
        self.point = rc.Geometry.Point2d(Point.X,Point.Y)
        self.font = Font
        
    def DrawViewportWires(self,arg):
        arg.Display.Draw2dText(self.text,self.color,self.point,False,self.height,self.font)
# ---------- end dst ----------

# ---- group: Draw Curves with Custom Weights
thickness = Slider(5, range=0..20)
crv = Curve([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])
dc = DrawCurves(Curves=crv, Weight=thickness, Color=ColourSwatch(SwatchColor=RGB(0, 207, 255)))  # inputs Curves: list
# ---------- dc: Python ----------
"""
Minimal working prototype for implementing DrawViewportWires in GHPython.
    Inputs:
        Curves: Curves to render {list,curve}
        Weight: {item,int}
        Color: {item,color}
    Outputs:
    Remarks:
        Author: Anders Holden Deleuran (BIG IDEAS)
        Rhino: 6.24.20079.23341
        Version: 200401
"""

ghenv.Component.Name = "DrawCurves"
ghenv.Component.NickName = "DC"

from ghpythonlib.componentbase import executingcomponent as component
import Rhino as rc

class MyComponent(component):
    
    def RunScript(self,Curves,Weight,Color):
        self.curves = Curves
        self.weight = Weight
        self.color = Color
        
    def DrawViewportWires(self,arg):
        for crv in self.curves:
            arg.Display.DrawCurve(crv,self.color,self.weight)
# ---------- end dc ----------

# ---- group: Draw Flat Shaded Two-Sided Mesh with Custom Wire Thickness/Color
mesh = Mesh(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)
dmf = DrawMeshFlat(
    Mesh=mesh,
    FrontColor=ColourSwatch(SwatchColor=RGB(235, 235, 235)),
    BackColor=ColourSwatch(SwatchColor=RGB(255, 127, 0)),
    EdgeColor=ColourSwatch(SwatchColor=RGB(0, 0, 0)),
    EdgeWidth=Slider(3, range=0..10))
# ---------- dmf: Python ----------
"""
How to add to rendered display mode.
https://discourse.mcneel.com/t/grasshopper-mesh-rendering-preview-in-c/82069
"""

ghenv.Component.Name = "DrawMeshFlat"
ghenv.Component.NickName = "DMF"

from ghpythonlib.componentbase import executingcomponent as component
import Rhino as rc
from System.Drawing import Color

class MyComponent(component):
    
    def RunScript(self,Mesh,FrontColor,BackColor,EdgeColor,EdgeWidth):
        self.mesh = Mesh
        self.edgeColor = EdgeColor
        self.edgeWidth = EdgeWidth
        
        # Set front colors
        self.material = rc.Display.DisplayMaterial(Color.Black)
        self.material.Emission = FrontColor
        
        # Color back faces
        if BackColor:
            self.material.IsTwoSided = True
            self.material.BackDiffuse = Color.Black
            self.material.BackEmission = BackColor
            
    def DrawViewportMeshes(self,arg):
        arg.Display.DrawMeshShaded(self.mesh,self.material)
        
    def DrawViewportWires(self,arg):
        arg.Display.DrawMeshWires(self.mesh,self.edgeColor,self.edgeWidth)
# ---------- end dmf ----------

# ---- group: Draw Curves with Custom Weights
thickness_2 = Slider(7, range=0..20)
crv_2 = Curve([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])
dc_2 = DrawCurves(Curves=crv_2, Weight=thickness_2, Color=ColourSwatch(SwatchColor=RGB(168, 0, 0)))  # inputs Curves: list
# ---------- dc_2: Python ----------
"""
Minimal working prototype for implementing DrawViewportWires in GHPython.
    Inputs:
        Curves: Curves to render {list,curve}
        Weight: {item,int}
        Color: {item,color}
    Outputs:
    Remarks:
        Author: Anders Holden Deleuran (BIG IDEAS)
        Rhino: 6.24.20079.23341
        Version: 200401
"""

ghenv.Component.Name = "DrawCurves"
ghenv.Component.NickName = "DC"

from ghpythonlib.componentbase import executingcomponent as component
import Rhino as rc
import Rhino.Geometry as rg


class MyComponent(component):
    
    def RunScript(self,Curves,Weight,Color):
        self.curves = Curves
        self.weight = Weight
        self.color = Color
       
        Point = []
        for i in range(0,20):
            Point.append(rg.Point3d(i,0,0))
        
        self.points = Point
        
    def DrawViewportWires(self,arg):
        for crv in self.curves:
            arg.Display.DrawCurve(crv,self.color,self.weight)
        
        for point in self.points:
            arg.Display.DrawPoint(point)
# ---------- end dc_2 ----------
